# Dynamo graph Beam1_RUN BEAM ANNOTATION SCRIPT ON ALL BEAMS.dyn "BEAM_ANNOTATIONS_DYNAMO PLAYER" (Dynamo 2.3.0.5885)
# packages: Genius Loci 2021.6.3, archi-lab.net 2020.23.12, Clockwork for Dynamo 0.9.x 0.90.8, Autodesk Analytical Modeling 2020 Dynamo 1.0.54

# group: Choose elements from revit
select_model_elements = DSModelElementsSelection()  # 43 picked in the model; graph input
isFraming = Dynamo4AM.Utilities.FilterElements.IsFraming(obj=select_model_elements)
filterByBoolMask = List.FilterByBoolMask(list=select_model_elements, mask=isFraming)

# group: Sorting beams on basis of material
code_block = CodeBlock { "Structural Material"; }
getParameterValueByName = Element.GetParameterValueByName(element=filterByBoolMask.in, parameterName=code_block)
name = Element.Name(element=getParameterValueByName)
code_block_2 = CodeBlock { "C"; }
boolean = BoolSelector(true)
contains = String.Contains(str=name, searchFor=code_block_2, ignoreCase=boolean)
filterByBoolMask_2 = List.FilterByBoolMask(list=filterByBoolMask.in, mask=contains)
getMaterials = Element.GetMaterials()  # unwired: element

# group: Create a project parameter "Is Cantilever" and sort the beams on basis on the value assigned to the parameter
code_block_3 = CodeBlock { "Is Cantilever"; }
getParameterValueByName_2 = Element.GetParameterValueByName(element=filterByBoolMask_2.in, parameterName=code_block_3)
code_block_4 = CodeBlock { "y"; }
eq = getParameterValueByName_2 == code_block_4
filterByBoolMask_3 = List.FilterByBoolMask(list=filterByBoolMask_2.in, mask=eq)
identity = Object.Identity(obj=filterByBoolMask_3.in)

# group: Getting rotation of beams with x-axis
element_getrotation = Custom[Element GetRotation](element=filterByBoolMask_3.out)  # package Genius Loci; Calculates the rotation angle between the given element and the X axis. Works for point/ line/ sketch based elements and link instances.
code_block_5 = CodeBlock { 2; }
round = Math.Round(number=element_getrotation, digits=code_block_5)

# group: Getting Vertical Beams
code_block_6 = CodeBlock { 45; 135; }
ge = round >= code_block_6.out0
le = round <= code_block_6.out1
and_ = ge && le
filterByBoolMask_4 = List.FilterByBoolMask(list=filterByBoolMask_3.out, mask=and_)
code_block_7 = CodeBlock { 225; 315; }
ge_2 = round >= code_block_7.out0
le_2 = round <= code_block_7.out1
and_2 = ge_2 && le_2
filterByBoolMask_5 = List.FilterByBoolMask(list=filterByBoolMask_3.out, mask=and_2)
list_create = List.Create(item0=filterByBoolMask_4.in, item1=filterByBoolMask_5.in)

# group: Sorting beams parallel to Y-Axis on basis os start point. Always model beams from bottom to top. Sorting Sequence=start point(y)>start point(x)
flatten = List.Flatten(list=list_create)
location = StructuralFraming.Location(structuralFraming=flatten)
startPoint = Curve.StartPoint(curve=location)
Y = Point.Y(point=startPoint)

code_block_8 = CodeBlock { 2; }
round_2 = Math.Round(number=Y, digits=code_block_8)

# group (continued): Sorting beams parallel to Y-Axis on basis os start point. Always model beams from bottom to top. Sorting Sequence=start point(y)>start point(x)
sortByKey = List.SortByKey(list=flatten, keys=round_2)
identity_2 = Object.Identity(obj=sortByKey.sorted_list)
location_2 = StructuralFraming.Location(structuralFraming=identity_2)
startPoint_2 = Curve.StartPoint(curve=location_2)
X = Point.X(point=startPoint_2)

code_block_9 = CodeBlock { 2; }
round_3 = Math.Round(number=X, digits=code_block_9)

# group (continued): Sorting beams parallel to Y-Axis on basis os start point. Always model beams from bottom to top. Sorting Sequence=start point(y)>start point(x)
sortByKey_2 = List.SortByKey(list=identity_2, keys=round_3)

# group: Values from user
enter_level_number = StringInput("2")  # graph input
enter_suffix_for_horizontal_beam = StringInput("HB")  # graph input
enter_suffix_for_vertical_beams = StringInput("VB")  # graph input
number_slider_for_horizontal = DoubleSlider(1, range=0..500 step 1)  # "Number Slider For horizontal Beams"; graph input
number_slider_gor_vertical_beams = DoubleSlider(1, range=0..500 step 1)  # graph input

# group: Getting Horizontal beams
code_block_10 = CodeBlock { 0; 44.99; }
ge_3 = round >= code_block_10.out0
le_3 = round <= code_block_10.out1
and_3 = ge_3 && le_3
filterByBoolMask_6 = List.FilterByBoolMask(list=filterByBoolMask_3.out, mask=and_3)
code_block_11 = CodeBlock { 135.01; 224.99; }
ge_4 = round >= code_block_11.out0
le_4 = round <= code_block_11.out1
and_4 = ge_4 && le_4
filterByBoolMask_7 = List.FilterByBoolMask(list=filterByBoolMask_3.out, mask=and_4)
code_block_12 = CodeBlock { 315.01; 360; }
ge_5 = round >= code_block_12.out0
le_5 = round <= code_block_12.out1
and_5 = ge_5 && le_5
filterByBoolMask_8 = List.FilterByBoolMask(list=filterByBoolMask_3.out, mask=and_5)
list_create_2 = List.Create(item0=filterByBoolMask_6.in, item1=filterByBoolMask_7.in, item2=filterByBoolMask_8.in)
flatten_2 = List.Flatten(list=list_create_2)

# group: Sorting beams parallel to X-axis on basis of start point. Always model beams from left to right. Sorting sequence= start point(x)>Reverse>start coordinate(y)>Reverse
object_identity_x_direction = Object.Identity(obj=flatten_2)
location_3 = StructuralFraming.Location(structuralFraming=object_identity_x_direction)
startPoint_3 = Curve.StartPoint(curve=location_3)
X_2 = Point.X(point=startPoint_3)

code_block_13 = CodeBlock { 2; }
round_4 = Math.Round(number=X_2, digits=code_block_13)

# group (continued): Sorting beams parallel to X-axis on basis of start point. Always model beams from left to right. Sorting sequence= start point(x)>Reverse>start coordinate(y)>Reverse
sortByKey_3 = List.SortByKey(list=object_identity_x_direction, keys=round_4)
reverse = List.Reverse(list=sortByKey_3.sorted_list)
identity_3 = Object.Identity(obj=reverse)
location_4 = StructuralFraming.Location(structuralFraming=identity_3)

endPoint = Curve.EndPoint(curve=location_4)

# group (continued): Sorting beams parallel to X-axis on basis of start point. Always model beams from left to right. Sorting sequence= start point(x)>Reverse>start coordinate(y)>Reverse
Y_2 = Point.Y(point=endPoint)

code_block_14 = CodeBlock { 2; }
round_5 = Math.Round(number=Y_2, digits=code_block_14)

# group (continued): Sorting beams parallel to X-axis on basis of start point. Always model beams from left to right. Sorting sequence= start point(x)>Reverse>start coordinate(y)>Reverse
sortByKey_4 = List.SortByKey(list=identity_3, keys=round_5)
reverse_2 = List.Reverse(list=sortByKey_4.sorted_list)

code_block_15 = CodeBlock(l=enter_level_number, hb=enter_suffix_for_horizontal_beam, vb=enter_suffix_for_vertical_beams, n=number_slider_for_horizontal, m=number_slider_gor_vertical_beams, x=reverse_2, y=flatten) { l; hb; vb; n; m; l+hb+(n..(n+(List.Count(x)-1))..1); l+vb+(m..(m+(List.Count(y)-1))..1); }
code_block_16 = CodeBlock { "."; }
split = String.Split(str=code_block_15.out6, separator0=code_block_16)
code_block_17 = CodeBlock { 0; }
getItemAtIndex = List.GetItemAtIndex(list=split@L2, index=code_block_17)

# group: Setting mark values for vertical beams
code_block_18 = CodeBlock { "Mark"; }
setParameterByName = Element.SetParameterByName(element=sortByKey_2.sorted_list, parameterName=code_block_18, value=getItemAtIndex)

split_2 = String.Split(str=code_block_15.out5, separator0=code_block_16)
getItemAtIndex_2 = List.GetItemAtIndex(list=split_2@L2, index=code_block_17)

# group: Setting mark values horizontal Beams
code_block_19 = CodeBlock { "Mark"; }
setParameterByName_2 = Element.SetParameterByName(element=reverse_2, parameterName=code_block_19, value=getItemAtIndex_2)

# group: Name for cantilever beam
enter_name_for_cantilever_beams = StringInput("")  # graph input

# group: Setting mark value as CANT for cantilever beam
code_block_20 = CodeBlock { "Mark"; }
setParameterByName_3 = Element.SetParameterByName(element=identity, parameterName=code_block_20, value=enter_name_for_cantilever_beams)

# group: Sort steel beams on basis on their size
identity_4 = Object.Identity(obj=filterByBoolMask_2.out)
code_block_21 = CodeBlock()
# ---------- code_block_21.designscript (6 lines) ----------
"
output = []
for x in IN[0]:
    output.append(float(filter(str.isdigit, x)))
OUT = output
";
# ----------------------------------------
type = archilab.Revit.Elements.Elements.Type(element=identity_4)
name_2 = Element.Name(element=type)
python_script_from_string = PythonStringNode(script=code_block_21, IN[0]=name_2)
string_from_object = FromObject(obj=python_script_from_string)
code_block_22 = CodeBlock { 0; 3; }
substring = String.Substring(str=string_from_object, startIndex=code_block_22.out0, length=code_block_22.out1)
sortByKey_5 = List.SortByKey(list=identity_4, keys=substring)

# group: steel beam title
enter_suffix_for_the_steel_beam = StringInput("")  # graph input

# group: Grouping similar steel beams
identity_5 = Object.Identity(obj=sortByKey_5.sorted_list)
type_2 = archilab.Revit.Elements.Elements.Type(element=identity_5)
sortByKey_6 = List.SortByKey(list=type_2, keys=sortByKey_5.sorted_keys)
countOccurences = Custom[List.CountOccurences](seq=sortByKey_6.sorted_list)  # package Clockwork for Dynamo 0.9.x; Counts the number of occurences of each unique element in a given list
count = List.Count(list=countOccurences.count)
code_block_23 = CodeBlock(st=enter_suffix_for_the_steel_beam, x=count) { st; st + (1..x..1); }
countOccurences_2 = Custom[List.CountOccurences](seq=sortByKey_6.sorted_list)

# group: Setting mark values for steel beams
code_block_24 = CodeBlock { "Mark"; }
cycle = List.Cycle(list=code_block_23.out1@L1, amount=countOccurences_2.count@L1)
flatten_3 = List.Flatten(list=cycle)
setParameterByName_4 = Element.SetParameterByName(element=sortByKey_5.sorted_list, parameterName=code_block_24, value=flatten_3)
