# Dynamo graph Beam4_DELETE MARK VALUES FOR BEAMS.dyn "DELETE MMARK VALUES FOR BEAMS" (Dynamo 2.3.0.5885)
# packages: Autodesk Analytical Modeling 2020 Dynamo 1.0.54

select_model_elements = DSModelElementsSelection()  # 7 picked in the model; graph input
isFraming = Dynamo4AM.Utilities.FilterElements.IsFraming(obj=select_model_elements)
filterByBoolMask = List.FilterByBoolMask(list=select_model_elements, mask=isFraming)
code_block = CodeBlock { "Mark"; }
code_block_2 = CodeBlock { ""; }
setParameterByName = Element.SetParameterByName(element=filterByBoolMask.in, parameterName=code_block, value=code_block_2)
