# Dynamo graph Beam3_ CORRECTION DONE TO VERTICAL BEAMS.dyn "B3_Step 3 CORRECTION DONE TO VERTICAL BEAMS" (Dynamo 2.6.1.8786)
# packages: Genius Loci 2021.6.3, archi-lab.net 2020.23.12, Clockwork for Dynamo 0.9.x 0.90.8, Autodesk Analytical Modeling 2020 Dynamo 1.0.54, Synthesize toolkit 11.7.3

# group: Choose elements from revit
select_model_elements = DSModelElementsSelection()  # 33 picked in the model; graph input
isFraming = Dynamo4AM.Utilities.FilterElements.IsFraming(obj=select_model_elements)
filterByBoolMask = List.FilterByBoolMask(list=select_model_elements, mask=isFraming)

# group: Sorting beams on basis of material
code_block = CodeBlock { "Structural Material"; }
getParameterValueByName = Element.GetParameterValueByName(element=filterByBoolMask.in, parameterName=code_block)
name = Element.Name(element=getParameterValueByName)
code_block_2 = CodeBlock { "C"; }
boolean = BoolSelector(true)
contains = String.Contains(str=name, searchFor=code_block_2, ignoreCase=boolean)
filterByBoolMask_2 = List.FilterByBoolMask(list=filterByBoolMask.in, mask=contains)
getMaterials = Element.GetMaterials()  # unwired: element

# group: Create a project parameter "Is Cantilever" and sort the beams on basis on the value assigned to the parameter
code_block_3 = CodeBlock { "Is Cantilever"; }
getParameterValueByName_2 = Element.GetParameterValueByName(element=filterByBoolMask_2.in, parameterName=code_block_3)
code_block_4 = CodeBlock { "y"; }
eq = getParameterValueByName_2 == code_block_4
filterByBoolMask_3 = List.FilterByBoolMask(list=filterByBoolMask_2.in, mask=eq)
identity = Object.Identity(obj=filterByBoolMask_3.in)

# group: Getting rotation of beams with x-axis
element_getrotation = Custom[Element GetRotation](element=filterByBoolMask_3.out)  # package Genius Loci; Calculates the rotation angle between the given element and the X axis. Works for point/ line/ sketch based elements and link instances.
code_block_5 = CodeBlock { 2; }
round = Math.Round(number=element_getrotation, digits=code_block_5)

# group: Getting Vertical Beams
code_block_6 = CodeBlock { 45; 135; }
ge = round >= code_block_6.out0
le = round <= code_block_6.out1
and_ = ge && le
filterByBoolMask_4 = List.FilterByBoolMask(list=filterByBoolMask_3.out, mask=and_)
code_block_7 = CodeBlock { 225; 315; }
ge_2 = round >= code_block_7.out0
le_2 = round <= code_block_7.out1
and_2 = ge_2 && le_2
filterByBoolMask_5 = List.FilterByBoolMask(list=filterByBoolMask_3.out, mask=and_2)
list_create = List.Create(item0=filterByBoolMask_4.in, item1=filterByBoolMask_5.in)

flatten = List.Flatten(list=list_create)

# group: Choose elements from revit
select_element_from_which_offset = DSModelElementsSelection()  # "Select element from which offset is calculated"; 1 picked in the model; graph input
isFraming_2 = Dynamo4AM.Utilities.FilterElements.IsFraming(obj=select_element_from_which_offset)
filterByBoolMask_6 = List.FilterByBoolMask(list=select_element_from_which_offset, mask=isFraming_2)

# group: offset values from user
offset_value_negative = DoubleSlider(1, range=0..50 step 0.01)  # graph input
offset_value_positive = DoubleSlider(1, range=0..50 step 0.01)  # graph input

# group: Vertical beams sorted
location = StructuralFraming.Location(structuralFraming=filterByBoolMask_6.in)
startPoint = Curve.StartPoint(curve=location)
X = Point.X(point=startPoint)
sub = X - offset_value_negative
add = X + offset_value_positive
count = List.Count(list=flatten)
code_block_8 = CodeBlock(Start=sub, end=add, count=count) { Start..end..#count; }
as_list_sortbykey = Custom[AS.[&] List.SortByKey](VARlist=flatten, VARkeys=code_block_8)  # package Synthesize toolkit; Sort a list (or lists) according to the order specified by the key list.
code_block_9 = CodeBlock { 3; }
flatten_2 = List.Flatten(list=as_list_sortbykey.VARsortedlist, amt=code_block_9)
location_2 = StructuralFraming.Location(structuralFraming=flatten)
startPoint_2 = Curve.StartPoint(curve=location_2)
Y = Point.Y(point=startPoint_2)
as_list_sortbykey_2 = Custom[AS.[&] List.SortByKey](VARlist=flatten_2, VARkeys=Y)
flatten_3 = List.Flatten(list=as_list_sortbykey_2.VARsortedlist, amt=code_block_9)

# group: Values from user
enter_level_number = StringInput("2")  # graph input
enter_suffix_for_vertical_beams = StringInput("VB")  # graph input
number_slider_gor_vertical_beams = DoubleSlider(24, range=0..500 step 1)  # graph input

code_block_10 = CodeBlock(l=enter_level_number, vb=enter_suffix_for_vertical_beams, m=number_slider_gor_vertical_beams, y=flatten_3) { l; vb; m; l+vb+(m..(m+(List.Count(y)-1))..1); }
code_block_11 = CodeBlock { "."; }
split = String.Split(str=code_block_10.out3, separator0=code_block_11)
code_block_12 = CodeBlock { 0; }
getItemAtIndex = List.GetItemAtIndex(list=split@L2, index=code_block_12)

# group: Setting mark values for vertical beams
code_block_13 = CodeBlock { "Mark"; }
setParameterByName = Element.SetParameterByName(element=flatten_3, parameterName=code_block_13, value=getItemAtIndex)

# group: Name for cantilever beam
enter_name_for_cantilever_beams = StringInput("")  # graph input

# group: Setting mark value as CANT for cantilever beam
code_block_14 = CodeBlock { "Mark"; }
setParameterByName_2 = Element.SetParameterByName(element=identity, parameterName=code_block_14, value=enter_name_for_cantilever_beams)

# group: Sort steel beams on basis on their size
identity_2 = Object.Identity(obj=filterByBoolMask_2.out)
code_block_15 = CodeBlock()
# ---------- code_block_15.designscript (6 lines) ----------
"
output = []
for x in IN[0]:
    output.append(float(filter(str.isdigit, x)))
OUT = output
";
# ----------------------------------------
type = archilab.Revit.Elements.Elements.Type(element=identity_2)
name_2 = Element.Name(element=type)
python_script_from_string = PythonStringNode(script=code_block_15, IN[0]=name_2)
string_from_object = FromObject(obj=python_script_from_string)
code_block_16 = CodeBlock { 0; 3; }
substring = String.Substring(str=string_from_object, startIndex=code_block_16.out0, length=code_block_16.out1)
sortByKey = List.SortByKey(list=identity_2, keys=substring)

# group: steel beam title
enter_suffix_for_the_steel_beam = StringInput("")  # graph input

# group: Grouping similar steel beams
identity_3 = Object.Identity(obj=sortByKey.sorted_list)
type_2 = archilab.Revit.Elements.Elements.Type(element=identity_3)
sortByKey_2 = List.SortByKey(list=type_2, keys=sortByKey.sorted_keys)
countOccurences = Custom[List.CountOccurences](seq=sortByKey_2.sorted_list)  # package Clockwork for Dynamo 0.9.x; Counts the number of occurences of each unique element in a given list
count_2 = List.Count(list=countOccurences.count)
code_block_17 = CodeBlock(st=enter_suffix_for_the_steel_beam, x=count_2) { st; st + (1..x..1); }
countOccurences_2 = Custom[List.CountOccurences](seq=sortByKey_2.sorted_list)

# group: Setting mark values for steel beams
code_block_18 = CodeBlock { "Mark"; }
cycle = List.Cycle(list=code_block_17.out1@L1, amount=countOccurences_2.count@L1)
flatten_4 = List.Flatten(list=cycle)
setParameterByName_3 = Element.SetParameterByName(element=sortByKey.sorted_list, parameterName=code_block_18, value=flatten_4)
