# Dynamo graph STEP 1_EXTRACT COORDINATES OF ALL ANALYTICAL NODES_SAME ORDER.dyn "EXTRACT COORDINATES OF ALL ANALYTICAL NODES_SAME ORDER" (Dynamo 2.6.1.8786)

categories = Categories("OST_AnalyticalNodes")
all_elements_of_category = ElementsOfCategory(Category=categories)
count = List.Count(list=all_elements_of_category)
code_block = CodeBlock(X=count) { 1..X..2; }
getItemAtIndex = List.GetItemAtIndex(list=all_elements_of_category, index=code_block)
code_block_2 = CodeBlock()
# ---------- code_block_2.designscript (3 lines) ----------
["X Position",
"Y Position",
"Z Position"];
# ----------------------------------------
count_2 = List.Count(list=getItemAtIndex)
ofRepeatedItem = List.OfRepeatedItem(item=code_block_2, amount=count_2)
X = ReferencePoint.X(referencePoint=getItemAtIndex)
code_block_3 = CodeBlock { 2; }
round = Math.Round(number=X, digits=code_block_3)
Y = ReferencePoint.Y(referencePoint=getItemAtIndex)
round_2 = Math.Round(number=Y, digits=code_block_3)
Z = ReferencePoint.Z(referencePoint=getItemAtIndex)
round_3 = Math.Round(number=Z, digits=code_block_3)
list_create = List.Create(item0=round, item1=round_2, item2=round_3)
transpose = List.Transpose(lists=list_create)
count_3 = List.Count(list=code_block_2)
chop = List.Chop(list=transpose@L2, lengths=count_3)
code_block_4 = CodeBlock { 1; }
flatten = List.Flatten(list=chop, amt=code_block_4)
setParameterByName = Element.SetParameterByName(element=getItemAtIndex, parameterName=ofRepeatedItem, value=flatten)
code_block_5 = CodeBlock { "Node Number"; }
code_block_6 = CodeBlock(x=count_2) { 0..x..1; }
setParameterByName_2 = Element.SetParameterByName(element=getItemAtIndex, parameterName=code_block_5, value=code_block_6)
