# Dynamo graph STEP 2_EXTRACT BEAM START AND END NODES .dyn "EXTRACT BEAM START AND END NODES" (Dynamo 2.6.1.8786)
# packages: Autodesk Analytical Modeling 2021 Dynamo 1.0.2

categories = Categories("OST_StructuralFraming")
all_elements_of_category = ElementsOfCategory(Category=categories)
boolean = BoolSelector(true)
getAnalyticalElement = Dynamo4AM.Utilities.FilterElements.GetAnalyticalElement(obj=all_elements_of_category, validOnly=boolean)
boolean_2 = BoolSelector(false)
clean = List.Clean(list=getAnalyticalElement, preserveIndices=boolean_2)
code_block = CodeBlock()
# ---------- code_block.designscript (2 lines) ----------
["Start Node",
"End Node"];
# ----------------------------------------
getPointsFromAnalyticalElement = Dynamo4AM.Utilities.FilterElements.GetPointsFromAnalyticalElement(obj=clean)
count = List.Count(list=getPointsFromAnalyticalElement)
ofRepeatedItem = List.OfRepeatedItem(item=code_block, amount=count)
categories_2 = Categories("OST_AnalyticalNodes")
all_elements_of_category_2 = ElementsOfCategory(Category=categories_2)
count_2 = List.Count(list=all_elements_of_category_2)
code_block_2 = CodeBlock(x=count_2) { 1..x..2; }
code_block_3 = CodeBlock(t1=all_elements_of_category_2, t2=code_block_2) { t3 = List.GetItemAtIndex(t1, t2); }
X = ReferencePoint.X(referencePoint=code_block_3)
Y = ReferencePoint.Y(referencePoint=code_block_3)
Z = ReferencePoint.Z(referencePoint=code_block_3)
byCoordinates = Point.ByCoordinates(x=X, y=Y, z=Z)
string_from_object = FromObject(obj=byCoordinates)
code_block_4 = CodeBlock { 0; 1; }
getItemAtIndex = List.GetItemAtIndex(list=getPointsFromAnalyticalElement@L2, index=code_block_4.out0)
string_from_object_2 = FromObject(obj=getItemAtIndex)
indexOf = List.IndexOf(list=string_from_object, element=string_from_object_2)
getItemAtIndex_2 = List.GetItemAtIndex(list=getPointsFromAnalyticalElement@L2, index=code_block_4.out1)
string_from_object_3 = FromObject(obj=getItemAtIndex_2)
indexOf_2 = List.IndexOf(list=string_from_object, element=string_from_object_3)
list_create = List.Create(item0=indexOf, item1=indexOf_2)
transpose = List.Transpose(lists=list_create)
setParameterByName = Element.SetParameterByName(element=clean, parameterName=ofRepeatedItem, value=transpose)
identity = Object.Identity(obj=getPointsFromAnalyticalElement)
