# Dynamo graph STEP 3_BEAM AND COLUMN CHECK OF ANALYTICAL MODEL.dyn "BEAM AND COLUMN CHECK OF ANALYTICAL MODEL_added element id" (Dynamo 2.6.1.8786)
# packages: Autodesk Analytical Modeling 2021 Dynamo 1.0.2, Synthesize toolkit 11.7.3

file_path = Filename(".\No file selected.xlsx")  # graph input
code_block = CodeBlock { "Element id"; }
select_columns = DSModelElementsSelection()  # 104 picked in the model; graph input
isColumn = Dynamo4AM.Utilities.FilterElements.IsColumn(obj=select_columns)
filterByBoolMask = List.FilterByBoolMask(list=select_columns, mask=isColumn)

# group: Selecting the columns and getting their analytical counterpart and then acquiring analytical column coordinates
boolean = BoolSelector(true)
getAnalyticalElement = Dynamo4AM.Utilities.FilterElements.GetAnalyticalElement(obj=filterByBoolMask.in, validOnly=boolean)

boolean_2 = BoolSelector(false)
clean = List.Clean(list=getAnalyticalElement, preserveIndices=boolean_2)
id = Element.Id(element=clean)
addItemToFront = List.AddItemToFront(item=code_block, list=id)

# group (continued): Selecting the columns and getting their analytical counterpart and then acquiring analytical column coordinates
getPointsFromAnalyticalElement = Dynamo4AM.Utilities.FilterElements.GetPointsFromAnalyticalElement(obj=clean)

select_beams = DSModelElementsSelection()  # 24 picked in the model; graph input

# group: Select structural framing and get analytical countrpart
isFraming = Dynamo4AM.Utilities.FilterElements.IsFraming(obj=select_beams)
filterByBoolMask_2 = List.FilterByBoolMask(list=select_beams, mask=isFraming)
boolean_3 = BoolSelector(true)
getAnalyticalElement_2 = Dynamo4AM.Utilities.FilterElements.GetAnalyticalElement(obj=filterByBoolMask_2.in, validOnly=boolean_3)
boolean_4 = BoolSelector(false)
clean_2 = List.Clean(list=getAnalyticalElement_2, preserveIndices=boolean_4)

# group: Getting coordinates of analytical beams
getPointsFromAnalyticalElement_2 = Dynamo4AM.Utilities.FilterElements.GetPointsFromAnalyticalElement(obj=clean_2)
number_slider = DoubleSlider(0, range=0..1 step 1)
getItemAtIndex = List.GetItemAtIndex(list=getPointsFromAnalyticalElement_2@L2, index=number_slider)
number_slider_2 = DoubleSlider(1, range=0..1 step 1)
getItemAtIndex_2 = List.GetItemAtIndex(list=getPointsFromAnalyticalElement_2@L2, index=number_slider_2)

# group: Rounding points to two decimal places
round_coordinates_upto_decimal = DoubleSlider(1, range=0..5 step 1)  # "Round coordinates upto decimal points"; graph input
X = Point.X(point=getItemAtIndex)
round = Math.Round(number=X, digits=round_coordinates_upto_decimal)
Y = Point.Y(point=getItemAtIndex)
round_2 = Math.Round(number=Y, digits=round_coordinates_upto_decimal)
Z = Point.Z(point=getItemAtIndex)
round_3 = Math.Round(number=Z, digits=round_coordinates_upto_decimal)
byCoordinates = Point.ByCoordinates(x=round, y=round_2, z=round_3)
X_2 = Point.X(point=getItemAtIndex_2)
round_4 = Math.Round(number=X_2, digits=round_coordinates_upto_decimal)
Y_2 = Point.Y(point=getItemAtIndex_2)
round_5 = Math.Round(number=Y_2, digits=round_coordinates_upto_decimal)
Z_2 = Point.Z(point=getItemAtIndex_2)
round_6 = Math.Round(number=Z_2, digits=round_coordinates_upto_decimal)
byCoordinates_2 = Point.ByCoordinates(x=round_4, y=round_5, z=round_6)
byStartPointEndPoint = Line.ByStartPointEndPoint(startPoint=byCoordinates, endPoint=byCoordinates_2)

# group: Comparing start and end coordinates of analytical column.
number_slider_3 = DoubleSlider(0, range=0..5 step 1)
getItemAtIndex_3 = List.GetItemAtIndex(list=getPointsFromAnalyticalElement@L2, index=number_slider_3)
X_3 = Point.X(point=getItemAtIndex_3)
round_7 = Math.Round(number=X_3, digits=round_coordinates_upto_decimal)
Y_3 = Point.Y(point=getItemAtIndex_3)
round_8 = Math.Round(number=Y_3, digits=round_coordinates_upto_decimal)
Z_3 = Point.Z(point=getItemAtIndex_3)
round_9 = Math.Round(number=Z_3, digits=round_coordinates_upto_decimal)
number_slider_4 = DoubleSlider(1, range=0..5 step 1)
getItemAtIndex_4 = List.GetItemAtIndex(list=getPointsFromAnalyticalElement@L2, index=number_slider_4)
X_4 = Point.X(point=getItemAtIndex_4)
round_10 = Math.Round(number=X_4, digits=round_coordinates_upto_decimal)
Y_4 = Point.Y(point=getItemAtIndex_4)
round_11 = Math.Round(number=Y_4, digits=round_coordinates_upto_decimal)
Z_4 = Point.Z(point=getItemAtIndex_4)
round_12 = Math.Round(number=Z_4, digits=round_coordinates_upto_decimal)
eq = round_7 == round_10
filterByBoolMask_3 = List.FilterByBoolMask(list=round_7, mask=eq)
eq_2 = round_8 == round_11
filterByBoolMask_4 = List.FilterByBoolMask(list=round_8, mask=eq_2)
code_block_2 = CodeBlock { 2; }

# group: Creating Sheets and columns for excel sheets
code_block_3 = CodeBlock { "Start_X"; "Start_Y"; "Start_Z"; "End_X"; "End_Y"; "End_Z"; "column"; }
code_block_4 = CodeBlock { "Type"; "Mark"; }
getParameterValueByName = Element.GetParameterValueByName(element=filterByBoolMask.in, parameterName=code_block_4.out0)
getParameterValueByName_2 = Element.GetParameterValueByName(element=filterByBoolMask.in, parameterName=code_block_4.out1)
code_block_5 = CodeBlock { "-"; }
if_ = If(test=getParameterValueByName_2, true=getParameterValueByName_2, false=code_block_5)
addItemToFront_2 = List.AddItemToFront(item=code_block_3.out0, list=round_7)
addItemToFront_3 = List.AddItemToFront(item=code_block_3.out1, list=round_8)
addItemToFront_4 = List.AddItemToFront(item=code_block_3.out2, list=round_9)
addItemToFront_5 = List.AddItemToFront(item=code_block_3.out3, list=round_10)
addItemToFront_6 = List.AddItemToFront(item=code_block_3.out4, list=round_11)
addItemToFront_7 = List.AddItemToFront(item=code_block_3.out5, list=round_12)
list_create = List.Create(item0=addItemToFront, item1=getParameterValueByName, item2=if_, item3=addItemToFront_2, item4=addItemToFront_3, item5=addItemToFront_4, item6=addItemToFront_5, item7=addItemToFront_6, item8=addItemToFront_7)

# group: Writing data to excel sheet
code_block_6 = CodeBlock { 0; 0; }
transpose = List.Transpose(lists=list_create)
boolean_5 = BoolSelector(true)
exportExcel = Data.ExportExcel(filePath=file_path, sheetName=code_block_3.out6, startRow=code_block_6.out0, startCol=code_block_6.out1, data=transpose, overWrite=boolean_5)

# group: Sorting the problematic column and writing data to a excel sheet "problem_column" of same file.
code_block_7 = CodeBlock { "problem_column"; }
code_block_8 = CodeBlock { 0; 0; }
code_block_9 = CodeBlock { "problrm_x"; "problem_y"; }
addItemToFront_8 = List.AddItemToFront(item=code_block_9.out0, list=filterByBoolMask_3.out)
addItemToFront_9 = List.AddItemToFront(item=code_block_9.out1, list=filterByBoolMask_4.out)
list_create_2 = List.Create(item0=addItemToFront_8, item1=addItemToFront_9)
transpose_2 = List.Transpose(lists=list_create_2)
boolean_6 = BoolSelector(true)
exportExcel_2 = Data.ExportExcel(filePath=file_path, sheetName=code_block_7, startRow=code_block_8.out0, startCol=code_block_8.out1, data=transpose_2, overWrite=boolean_6)

# group: Writing data of all beams to an excel sheet eith name "Beam all"
code_block_10 = CodeBlock { 2; }
code_block_11 = CodeBlock { "Beams all"; }
code_block_12 = CodeBlock { 0; 0; }
beams_all = CodeBlock { "element id"; "Start_X"; "Start_Y"; "Start_Z"; "End_X"; "End_Y"; "End_Z"; }
getPointsFromAnalyticalElement_3 = Dynamo4AM.Utilities.FilterElements.GetPointsFromAnalyticalElement(obj=clean_2)
number_slider_5 = DoubleSlider(0, range=0..1 step 1)
getItemAtIndex_5 = List.GetItemAtIndex(list=getPointsFromAnalyticalElement_3@L2, index=number_slider_5)
X_5 = Point.X(point=getItemAtIndex_5)
round_13 = Math.Round(number=X_5, digits=round_coordinates_upto_decimal)
addItemToFront_10 = List.AddItemToFront(item=beams_all.out1, list=round_13)
Y_5 = Point.Y(point=getItemAtIndex_5)
round_14 = Math.Round(number=Y_5, digits=round_coordinates_upto_decimal)
addItemToFront_11 = List.AddItemToFront(item=beams_all.out2, list=round_14)
Z_5 = Point.Z(point=getItemAtIndex_5)
round_15 = Math.Round(number=Z_5, digits=round_coordinates_upto_decimal)
addItemToFront_12 = List.AddItemToFront(item=beams_all.out3, list=round_15)
number_slider_6 = DoubleSlider(1, range=0..1 step 1)
getItemAtIndex_6 = List.GetItemAtIndex(list=getPointsFromAnalyticalElement_3@L2, index=number_slider_6)
X_6 = Point.X(point=getItemAtIndex_6)
round_16 = Math.Round(number=X_6, digits=round_coordinates_upto_decimal)
addItemToFront_13 = List.AddItemToFront(item=beams_all.out4, list=round_16)
Y_6 = Point.Y(point=getItemAtIndex_6)
round_17 = Math.Round(number=Y_6, digits=round_coordinates_upto_decimal)
addItemToFront_14 = List.AddItemToFront(item=beams_all.out5, list=round_17)
Z_6 = Point.Z(point=getItemAtIndex_6)
round_18 = Math.Round(number=Z_6, digits=round_coordinates_upto_decimal)
addItemToFront_15 = List.AddItemToFront(item=beams_all.out6, list=round_18)
boolean_7 = BoolSelector(true)

# group: Sorting beams parallel to x-axis
direction = Line.Direction(line=byStartPointEndPoint)
normalized = Vector.Normalized(vector=direction)
XAxis = Vector.XAxis()
isParallel = Vector.IsParallel(vector=normalized, other=XAxis)
filterByBoolMask_5 = List.FilterByBoolMask(list=clean_2, mask=isParallel)

# group: Getting start and end coordinates(x,y,z) of analytical beams
code_block_13 = CodeBlock { 2; }
getPointsFromAnalyticalElement_4 = Dynamo4AM.Utilities.FilterElements.GetPointsFromAnalyticalElement(obj=filterByBoolMask_5.in@L1)
number_slider_7 = DoubleSlider(0, range=0..1 step 1)
getItemAtIndex_7 = List.GetItemAtIndex(list=getPointsFromAnalyticalElement_4@L2, index=number_slider_7)
X_7 = Point.X(point=getItemAtIndex_7)
round_19 = Math.Round(number=X_7, digits=round_coordinates_upto_decimal)
Y_7 = Point.Y(point=getItemAtIndex_7)
round_20 = Math.Round(number=Y_7, digits=round_coordinates_upto_decimal)
Z_7 = Point.Z(point=getItemAtIndex_7)
round_21 = Math.Round(number=Z_7, digits=round_coordinates_upto_decimal)
number_slider_8 = DoubleSlider(1, range=0..1 step 1)
getItemAtIndex_8 = List.GetItemAtIndex(list=getPointsFromAnalyticalElement_4@L2, index=number_slider_8)
X_8 = Point.X(point=getItemAtIndex_8)
round_22 = Math.Round(number=X_8, digits=round_coordinates_upto_decimal)
Y_8 = Point.Y(point=getItemAtIndex_8)
round_23 = Math.Round(number=Y_8, digits=round_coordinates_upto_decimal)
Z_8 = Point.Z(point=getItemAtIndex_8)
round_24 = Math.Round(number=Z_8, digits=round_coordinates_upto_decimal)

# group: Creating columns in excel sheets and writing data to sheet named "Beams parallel to x-axis"
code_block_14 = CodeBlock { "Beams parallel to x-axis"; }
code_block_15 = CodeBlock { 0; 0; }
beams_parallel_to_x_axis = CodeBlock { "Element id"; "Start_X"; "Start_Y"; "Start_Z"; "End_X"; "End_Y"; "End_Z"; }
id_2 = Element.Id(element=filterByBoolMask_5.in)
addItemToFront_16 = List.AddItemToFront(item=beams_parallel_to_x_axis.out0, list=id_2)
addItemToFront_17 = List.AddItemToFront(item=beams_parallel_to_x_axis.out1, list=round_19)
addItemToFront_18 = List.AddItemToFront(item=beams_parallel_to_x_axis.out2, list=round_20)
addItemToFront_19 = List.AddItemToFront(item=beams_parallel_to_x_axis.out3, list=round_21)
addItemToFront_20 = List.AddItemToFront(item=beams_parallel_to_x_axis.out4, list=round_22)
addItemToFront_21 = List.AddItemToFront(item=beams_parallel_to_x_axis.out5, list=round_23)
addItemToFront_22 = List.AddItemToFront(item=beams_parallel_to_x_axis.out6, list=round_24)
list_create_3 = List.Create(item0=addItemToFront_16, item1=addItemToFront_17, item2=addItemToFront_18, item3=addItemToFront_19, item4=addItemToFront_20, item5=addItemToFront_21, item6=addItemToFront_22)
transpose_3 = List.Transpose(lists=list_create_3)
boolean_8 = BoolSelector(true)
exportExcel_3 = Data.ExportExcel(filePath=file_path, sheetName=code_block_14, startRow=code_block_15.out0, startCol=code_block_15.out1, data=transpose_3, overWrite=boolean_8)

# group: Further Sorting Beams Parallel to y-axis
getPointsFromAnalyticalElement_5 = Dynamo4AM.Utilities.FilterElements.GetPointsFromAnalyticalElement(obj=filterByBoolMask_5.out@L1)
number_slider_9 = DoubleSlider(0, range=0..1 step 1)
getItemAtIndex_9 = List.GetItemAtIndex(list=getPointsFromAnalyticalElement_5@L2, index=number_slider_9)
number_slider_10 = DoubleSlider(1, range=0..1 step 1)
getItemAtIndex_10 = List.GetItemAtIndex(list=getPointsFromAnalyticalElement_5@L2, index=number_slider_10)
YAxis = Vector.YAxis()

X_9 = Point.X(point=getItemAtIndex_9)
round_25 = Math.Round(number=X_9, digits=round_coordinates_upto_decimal)
Y_9 = Point.Y(point=getItemAtIndex_9)
round_26 = Math.Round(number=Y_9, digits=round_coordinates_upto_decimal)
Z_9 = Point.Z(point=getItemAtIndex_9)
round_27 = Math.Round(number=Z_9, digits=round_coordinates_upto_decimal)
byCoordinates_3 = Point.ByCoordinates(x=round_25, y=round_26, z=round_27)
X_10 = Point.X(point=getItemAtIndex_10)
round_28 = Math.Round(number=X_10, digits=round_coordinates_upto_decimal)
Y_10 = Point.Y(point=getItemAtIndex_10)
round_29 = Math.Round(number=Y_10, digits=round_coordinates_upto_decimal)
Z_10 = Point.Z(point=getItemAtIndex_10)
round_30 = Math.Round(number=Z_10, digits=round_coordinates_upto_decimal)
byCoordinates_4 = Point.ByCoordinates(x=round_28, y=round_29, z=round_30)
byStartPointEndPoint_2 = Line.ByStartPointEndPoint(startPoint=byCoordinates_3, endPoint=byCoordinates_4)

# group (continued): Further Sorting Beams Parallel to y-axis
direction_2 = Line.Direction(line=byStartPointEndPoint_2)
normalized_2 = Vector.Normalized(vector=direction_2)
isParallel_2 = Vector.IsParallel(vector=normalized_2, other=YAxis)
filterByBoolMask_6 = List.FilterByBoolMask(list=filterByBoolMask_5.out, mask=isParallel_2)

# group: Getting coordinates of beam parallel to y-axis
code_block_16 = CodeBlock { 2; }
getPointsFromAnalyticalElement_6 = Dynamo4AM.Utilities.FilterElements.GetPointsFromAnalyticalElement(obj=filterByBoolMask_6.in)
number_slider_11 = DoubleSlider(0, range=0..1 step 1)
getItemAtIndex_11 = List.GetItemAtIndex(list=getPointsFromAnalyticalElement_6@L2, index=number_slider_11)
X_11 = Point.X(point=getItemAtIndex_11)
round_31 = Math.Round(number=X_11, digits=round_coordinates_upto_decimal)
Y_11 = Point.Y(point=getItemAtIndex_11)
round_32 = Math.Round(number=Y_11, digits=round_coordinates_upto_decimal)
Z_11 = Point.Z(point=getItemAtIndex_11)
round_33 = Math.Round(number=Z_11, digits=round_coordinates_upto_decimal)
number_slider_12 = DoubleSlider(1, range=0..1 step 1)
getItemAtIndex_12 = List.GetItemAtIndex(list=getPointsFromAnalyticalElement_6@L2, index=number_slider_12)
X_12 = Point.X(point=getItemAtIndex_12)
round_34 = Math.Round(number=X_12, digits=round_coordinates_upto_decimal)
Y_12 = Point.Y(point=getItemAtIndex_12)
round_35 = Math.Round(number=Y_12, digits=round_coordinates_upto_decimal)
Z_12 = Point.Z(point=getItemAtIndex_12)
round_36 = Math.Round(number=Z_12, digits=round_coordinates_upto_decimal)

# group: Getting information of problematic beams
code_block_17 = CodeBlock { 2; }
getPointsFromAnalyticalElement_7 = Dynamo4AM.Utilities.FilterElements.GetPointsFromAnalyticalElement(obj=filterByBoolMask_6.out)
number_slider_13 = DoubleSlider(0, range=0..1 step 1)
getItemAtIndex_13 = List.GetItemAtIndex(list=getPointsFromAnalyticalElement_7@L2, index=number_slider_13)
X_13 = Point.X(point=getItemAtIndex_13)
Y_13 = Point.Y(point=getItemAtIndex_13)
Z_13 = Point.Z(point=getItemAtIndex_13)
number_slider_14 = DoubleSlider(1, range=0..1 step 1)
getItemAtIndex_14 = List.GetItemAtIndex(list=getPointsFromAnalyticalElement_7@L2, index=number_slider_14)
X_14 = Point.X(point=getItemAtIndex_14)
Y_14 = Point.Y(point=getItemAtIndex_14)
Z_14 = Point.Z(point=getItemAtIndex_14)
round_37 = Math.Round(number=X_13, digits=round_coordinates_upto_decimal)
round_38 = Math.Round(number=Y_13, digits=round_coordinates_upto_decimal)
round_39 = Math.Round(number=Z_13, digits=round_coordinates_upto_decimal)
round_40 = Math.Round(number=X_14, digits=round_coordinates_upto_decimal)
round_41 = Math.Round(number=Y_14, digits=round_coordinates_upto_decimal)
round_42 = Math.Round(number=Z_14, digits=round_coordinates_upto_decimal)

# group: Creating columns in excel sheet named "Beams parallel to y-axis" and writing data to it.
code_block_18 = CodeBlock { "Beams parallel to y-axis"; }
code_block_19 = CodeBlock { 0; 0; }
beams_parallel_to_y_axis = CodeBlock { "Element id"; "Start_X"; "Start_Y"; "Start_Z"; "End_X"; "End_Y"; "End_Z"; }
id_3 = Element.Id(element=filterByBoolMask_5.out)
addItemToFront_23 = List.AddItemToFront(item=beams_parallel_to_y_axis.out0, list=id_3)
addItemToFront_24 = List.AddItemToFront(item=beams_parallel_to_y_axis.out1, list=round_31)
addItemToFront_25 = List.AddItemToFront(item=beams_parallel_to_y_axis.out2, list=round_32)
addItemToFront_26 = List.AddItemToFront(item=beams_parallel_to_y_axis.out3, list=round_33)
addItemToFront_27 = List.AddItemToFront(item=beams_parallel_to_y_axis.out4, list=round_34)
addItemToFront_28 = List.AddItemToFront(item=beams_parallel_to_y_axis.out5, list=round_35)
addItemToFront_29 = List.AddItemToFront(item=beams_parallel_to_y_axis.out6, list=round_36)
list_create_4 = List.Create(item0=addItemToFront_23, item1=addItemToFront_24, item2=addItemToFront_25, item3=addItemToFront_26, item4=addItemToFront_27, item5=addItemToFront_28, item6=addItemToFront_29)
transpose_4 = List.Transpose(lists=list_create_4)
boolean_9 = BoolSelector(true)
exportExcel_4 = Data.ExportExcel(filePath=file_path, sheetName=code_block_18, startRow=code_block_19.out0, startCol=code_block_19.out1, data=transpose_4, overWrite=boolean_9)

# group: creating columns for problematic beams in excel sheet
problematic_Beams = CodeBlock { "Start_X"; "Start_Y"; "Start_Z"; "End_X"; "End_Y"; "End_Z"; "element id"; }
id_4 = Element.Id(element=filterByBoolMask_6.out)
addItemToFront_30 = List.AddItemToFront(item=problematic_Beams.out6, list=id_4)
addItemToFront_31 = List.AddItemToFront(item=problematic_Beams.out0, list=X_13)
addItemToFront_32 = List.AddItemToFront(item=problematic_Beams.out1, list=Y_13)
addItemToFront_33 = List.AddItemToFront(item=problematic_Beams.out2, list=Z_13)
addItemToFront_34 = List.AddItemToFront(item=problematic_Beams.out3, list=X_14)
addItemToFront_35 = List.AddItemToFront(item=problematic_Beams.out4, list=Y_14)
addItemToFront_36 = List.AddItemToFront(item=problematic_Beams.out5, list=Z_14)

# group: Writing data into a sheet named "Problematic beams"
code_block_20 = CodeBlock { "Problematic beams"; }
code_block_21 = CodeBlock { 0; 0; }
list_create_5 = List.Create(item0=addItemToFront_30, item1=addItemToFront_31, item2=addItemToFront_32, item3=addItemToFront_33, item4=addItemToFront_34, item5=addItemToFront_35, item6=addItemToFront_36)
transpose_5 = List.Transpose(lists=list_create_5)
boolean_10 = BoolSelector(true)
exportExcel_5 = Data.ExportExcel(filePath=file_path, sheetName=code_block_20, startRow=code_block_21.out0, startCol=code_block_21.out1, data=transpose_5, overWrite=boolean_10)

id_5 = Element.Id(element=clean_2)
addItemToFront_37 = List.AddItemToFront(item=beams_all.out0, list=id_5)

# group (continued): Writing data of all beams to an excel sheet eith name "Beam all"
list_create_6 = List.Create(item0=addItemToFront_37, item1=addItemToFront_10, item2=addItemToFront_11, item3=addItemToFront_12, item4=addItemToFront_13, item5=addItemToFront_14, item6=addItemToFront_15)
transpose_6 = List.Transpose(lists=list_create_6)
exportExcel_6 = Data.ExportExcel(filePath=file_path, sheetName=code_block_11, startRow=code_block_12.out0, startCol=code_block_12.out1, data=transpose_6, overWrite=boolean_7)

# group: Overriding thr properties of problematic beams in a particular view
color_palette = ColorPalette({R: 220, G: 20, B: 60, A: 255})
code_block_22 = CodeBlock { 10; }
byProperties = Revit.Filter.OverrideGraphicSettings.ByProperties(cutLineColor=color_palette, projectionLineColor=color_palette, cutLineWeight=code_block_22, projectionLineWeight=code_block_22)
overrideInView = Element.OverrideInView(element=filterByBoolMask_6.out, overrides=byProperties)

roundToPrecision = Custom[CW.Math.RoundToPrecision]()  # package Synthesize toolkit; Rounds a number to a specified precision; unwired: VARdbl

# group: Overriding thr properties of problematic beams in a particular view
color_palette_2 = ColorPalette({R: 220, G: 20, B: 60, A: 255})
code_block_23 = CodeBlock { 10; }
byProperties_2 = Revit.Filter.OverrideGraphicSettings.ByProperties(cutLineColor=color_palette_2, projectionLineColor=color_palette_2, cutLineWeight=code_block_23, projectionLineWeight=code_block_23)
overrideInView_2 = Element.OverrideInView(element=filterByBoolMask_3.out, overrides=byProperties_2)

# group: creating columns for problematic beams in excel sheet
problematic_Beams_2 = CodeBlock { "Start_X"; "Start_Y"; "Start_Z"; "End_X"; "End_Y"; "End_Z"; "element id"; }
id_6 = Element.Id(element=filterByBoolMask_6.out)
addItemToFront_38 = List.AddItemToFront(item=problematic_Beams_2.out6, list=id_6)
addItemToFront_39 = List.AddItemToFront(item=problematic_Beams_2.out0, list=round_37)
addItemToFront_40 = List.AddItemToFront(item=problematic_Beams_2.out1, list=round_38)
addItemToFront_41 = List.AddItemToFront(item=problematic_Beams_2.out2, list=round_39)
addItemToFront_42 = List.AddItemToFront(item=problematic_Beams_2.out3, list=round_40)
addItemToFront_43 = List.AddItemToFront(item=problematic_Beams_2.out4, list=round_41)
addItemToFront_44 = List.AddItemToFront(item=problematic_Beams_2.out5, list=round_42)

# group: Writing data into a sheet named "Problematic beams"
code_block_24 = CodeBlock { "Problematic beams_rounded"; }
code_block_25 = CodeBlock { 0; 0; }
list_create_7 = List.Create(item0=addItemToFront_38, item1=addItemToFront_39, item2=addItemToFront_40, item3=addItemToFront_41, item4=addItemToFront_42, item5=addItemToFront_43, item6=addItemToFront_44)
transpose_7 = List.Transpose(lists=list_create_7)
boolean_11 = BoolSelector(true)
exportExcel_7 = Data.ExportExcel(filePath=file_path, sheetName=code_block_24, startRow=code_block_25.out0, startCol=code_block_25.out1, data=transpose_7, overWrite=boolean_11)

code_block_26 = CodeBlock {  }
