# Dynamo graph Column1_RUN SCRIPTS ON ALL COLUMNS.dyn "COLUMN ANNOTATION DYNAMO PLAYER" (Dynamo 2.6.1.8786)
# packages: Clockwork for Dynamo 0.9.x 0.90.8, Autodesk Analytical Modeling 2020 Dynamo 1.0.54

select_model_elements = DSModelElementsSelection()  # 16 picked in the model; graph input
isColumn = Dynamo4AM.Utilities.FilterElements.IsColumn(obj=select_model_elements)
filterByBoolMask = List.FilterByBoolMask(list=select_model_elements, mask=isColumn)

# group: Create a project parameter "Is Cantilever" and sort the beams on basis on the value assigned to the parameter
code_block = CodeBlock { "Is Transfer Column"; }
getParameterValueByName = Element.GetParameterValueByName(element=filterByBoolMask.in, parameterName=code_block)
code_block_2 = CodeBlock { "y"; }
eq = getParameterValueByName == code_block_2
filterByBoolMask_2 = List.FilterByBoolMask(list=filterByBoolMask.in, mask=eq)

# group: Sorting beams parallel to X-axis on basis of start point. Always model beams from left to right. Sorting sequence= start point(x)>Reverse>start coordinate(y)>Reverse
location = Custom[Element.Location](element=filterByBoolMask_2.out)  # package Clockwork for Dynamo 0.9.x; Returns the location of an element as point, curve or curve loop, along with some booleans to help filtering the results. Unlike the OOTB Element.GetLocation node, it also retunrs sketch lines of sketch-based elements like floor slabs as well as the element's rotation property.
X = Point.X(point=location.points)

code_block_3 = CodeBlock { 2; }
round = Math.Round(number=X, digits=code_block_3)

# group (continued): Sorting beams parallel to X-axis on basis of start point. Always model beams from left to right. Sorting sequence= start point(x)>Reverse>start coordinate(y)>Reverse
sortByKey = List.SortByKey(list=filterByBoolMask_2.out, keys=round)
reverse = List.Reverse(list=sortByKey.sorted_list)
identity = Object.Identity(obj=reverse)
location_2 = Custom[Element.Location](element=identity)
Y = Point.Y(point=location_2.points)

code_block_4 = CodeBlock { 2; }
round_2 = Math.Round(number=Y, digits=code_block_4)

# group (continued): Sorting beams parallel to X-axis on basis of start point. Always model beams from left to right. Sorting sequence= start point(x)>Reverse>start coordinate(y)>Reverse
sortByKey_2 = List.SortByKey(list=identity, keys=round_2)
reverse_2 = List.Reverse(list=sortByKey_2.sorted_list)

code_block_5 = CodeBlock { "Mark"; }

# group: Setting Mark values for Columns
starting_number_for_columns = DoubleSlider(0, range=0..500 step 1)  # graph input
suffix_for_column = StringInput("C")  # graph input
code_block_6 = CodeBlock(n=starting_number_for_columns, c=suffix_for_column, x=reverse_2) { n; c; c+(n..(n+(List.Count(x)-1))..1); }
code_block_7 = CodeBlock { "."; }
split = String.Split(str=code_block_6.out2, separator0=code_block_7)
code_block_8 = CodeBlock { 0; }
getItemAtIndex = List.GetItemAtIndex(list=split@L2, index=code_block_8)
setParameterByName = Element.SetParameterByName(element=reverse_2, parameterName=code_block_5, value=getItemAtIndex)

identity_2 = Object.Identity(obj=filterByBoolMask_2.in)

# group: Sorting beams parallel to X-axis on basis of start point. Always model beams from left to right. Sorting sequence= start point(x)>Reverse>start coordinate(y)>Reverse
location_3 = Custom[Element.Location](element=identity_2)
X_2 = Point.X(point=location_3.points)
sortByKey_3 = List.SortByKey(list=identity_2, keys=X_2)
reverse_3 = List.Reverse(list=sortByKey_3.sorted_list)
identity_3 = Object.Identity(obj=reverse_3)
location_4 = Custom[Element.Location](element=identity_3)
Y_2 = Point.Y(point=location_4.points)
sortByKey_4 = List.SortByKey(list=identity_3, keys=Y_2)
reverse_4 = List.Reverse(list=sortByKey_4.sorted_list)

# group: Setting Mark values for Columns
select_starting_number_for = DoubleSlider(0, range=0..500 step 1)  # "Select starting number for transfer column!!"; graph input
suffix_for_transfer_column = StringInput("TC")  # graph input
code_block_9 = CodeBlock(n=select_starting_number_for, c=suffix_for_transfer_column, x=reverse_4) { n; c; c+(n..(n+(List.Count(x)-1))..1); }
code_block_10 = CodeBlock { "."; }
split_2 = String.Split(str=code_block_9.out2, separator0=code_block_10)
code_block_11 = CodeBlock { 0; }
getItemAtIndex_2 = List.GetItemAtIndex(list=split_2@L2, index=code_block_11)
setParameterByName_2 = Element.SetParameterByName(element=reverse_4, parameterName=code_block_5, value=getItemAtIndex_2)
