# Dynamo graph Column2_CORRECTION DONE ON COLUMNS.dyn "COLUMN ANNOTATION DYNAMO PLAYER" (Dynamo 2.6.1.8786)
# packages: Autodesk Analytical Modeling 2020 Dynamo 1.0.54, Clockwork for Dynamo 0.9.x 0.90.8, Clockwork for Dynamo 2.x 2.3.0, Synthesize toolkit 11.7.3

select_all_columns = DSModelElementsSelection()  # 16 picked in the model; graph input
isColumn = Dynamo4AM.Utilities.FilterElements.IsColumn(obj=select_all_columns)
filterByBoolMask = List.FilterByBoolMask(list=select_all_columns, mask=isColumn)

# group: Create a project parameter "Is Cantilever" and sort the beams on basis on the value assigned to the parameter
code_block = CodeBlock { "Is Transfer Column"; }
getParameterValueByName = Element.GetParameterValueByName(element=filterByBoolMask.in, parameterName=code_block)
code_block_2 = CodeBlock { "y"; }
eq = getParameterValueByName == code_block_2
filterByBoolMask_2 = List.FilterByBoolMask(list=filterByBoolMask.in, mask=eq)

# group: Input from User
select_single_column_from_ehich = DSModelElementsSelection()  # "Select Single Column from ehich offset is calculated"; 2 picked in the model; graph input
isColumn_2 = Dynamo4AM.Utilities.FilterElements.IsColumn(obj=select_single_column_from_ehich)
filterByBoolMask_3 = List.FilterByBoolMask(list=select_single_column_from_ehich, mask=isColumn_2)

# group: Check the whether column within the range(y-coordinate) and then sort on basis of x coordinates
location = Custom[Element.Location](element=filterByBoolMask_3.in)  # package Clockwork for Dynamo 2.x; Returns the location of an element as point, curve or curve loop, along with some booleans to help filtering the results. Unlike the OOTB Element.GetLocation node, it also retunrs sketch lines of sketch-based elements like floor slabs as well as the element's rotation property.
Y = Point.Y(point=location.points)
number_slider = DoubleSlider(1.96, range=0..50 step 0.01)  # graph input
sub = Y - number_slider
number_slider_2 = DoubleSlider(3.94, range=0..50 step 0.01)  # graph input
add = Y + number_slider_2
count = List.Count(list=filterByBoolMask_2.out)
code_block_3 = CodeBlock(Start=sub, end=add, count=count) { Start..end..#count; }
code_block_4 = CodeBlock { 2; }
flatten = List.Flatten(list=code_block_3, amt=code_block_4)
as_list_sortbykey = Custom[AS.[&] List.SortByKey](VARlist=filterByBoolMask_2.out, VARkeys=flatten)  # package Synthesize toolkit; Sort a list (or lists) according to the order specified by the key list.
flatten_2 = List.Flatten(list=as_list_sortbykey.VARsortedlist, amt=code_block_4)
location_2 = Custom[Element.Location](element=filterByBoolMask_2.out)
X = Point.X(point=location_2.points)
as_list_sortbykey_2 = Custom[AS.[&] List.SortByKey](VARlist=flatten_2, VARkeys=X)
flatten_3 = List.Flatten(list=as_list_sortbykey_2.VARsortedlist, amt=code_block_4)

code_block_5 = CodeBlock { "Mark"; }

# group: Setting Mark values for Columns
starting_number_for_columns = DoubleSlider(1, range=1..500 step 1)  # graph input
suffix_for_column = StringInput("C")  # graph input
code_block_6 = CodeBlock(n=starting_number_for_columns, c=suffix_for_column, x=flatten_3) { n; c; c+(n..(n+(List.Count(x)-1))..1); }
code_block_7 = CodeBlock { "."; }
split = String.Split(str=code_block_6.out2, separator0=code_block_7)
code_block_8 = CodeBlock { 0; }
getItemAtIndex = List.GetItemAtIndex(list=split@L2, index=code_block_8)
setParameterByName = Element.SetParameterByName(element=flatten_3, parameterName=code_block_5, value=getItemAtIndex)

identity = Object.Identity(obj=filterByBoolMask_2.in)

# group: Sorting beams parallel to X-axis on basis of start point. Always model beams from left to right. Sorting sequence= start point(x)>Reverse>start coordinate(y)>Reverse
location_3 = Custom[Element.Location](element=identity)
X_2 = Point.X(point=location_3.points)
sortByKey = List.SortByKey(list=identity, keys=X_2)
reverse = List.Reverse(list=sortByKey.sorted_list)
identity_2 = Object.Identity(obj=reverse)
location_4 = Custom[Element.Location](element=identity_2)
Y_2 = Point.Y(point=location_4.points)
sortByKey_2 = List.SortByKey(list=identity_2, keys=Y_2)
reverse_2 = List.Reverse(list=sortByKey_2.sorted_list)

# group: Setting Mark values for Columns
select_starting_number_for = DoubleSlider(0, range=0..500 step 1)  # "Select starting number for transfer column!!"; graph input
suffix_for_transfer_column = StringInput("TC")  # graph input
code_block_9 = CodeBlock(n=select_starting_number_for, c=suffix_for_transfer_column, x=reverse_2) { n; c; c+(n..(n+(List.Count(x)-1))..1); }
code_block_10 = CodeBlock { "."; }
split_2 = String.Split(str=code_block_9.out2, separator0=code_block_10)
code_block_11 = CodeBlock { 0; }
getItemAtIndex_2 = List.GetItemAtIndex(list=split_2@L2, index=code_block_11)
setParameterByName_2 = Element.SetParameterByName(element=reverse_2, parameterName=code_block_5, value=getItemAtIndex_2)
