# Dynamo graph Column3_DELETE MARK VALUES FOR COLUMNS.dyn "DELETE MMARK VALUES FOR COLUMNS" (Dynamo 2.3.0.5885)
# packages: Autodesk Analytical Modeling 2020 Dynamo 1.0.54

select_model_elements = DSModelElementsSelection()  # 10 picked in the model; graph input
isColumn = Dynamo4AM.Utilities.FilterElements.IsColumn(obj=select_model_elements)
filterByBoolMask = List.FilterByBoolMask(list=select_model_elements, mask=isColumn)
code_block = CodeBlock { "Mark"; }
code_block_2 = CodeBlock { ""; }
setParameterByName = Element.SetParameterByName(element=filterByBoolMask.in, parameterName=code_block, value=code_block_2)
