# Dynamo graph GET_PARAMETERS_OF_BEAM_COLUMN_SLAB_FOUNDATOIN_WALL.dyn (Dynamo 2.16.1.2727)
# packages: archi-lab.net 2023.213.1722

# group: Inputs
file_path = Filename("..\..\RequiredParameters.csv")  # graph input
select_model_elements = DSModelElementsSelection()  # 10 picked in the model; graph input

code_block = CodeBlock { "ifcBeam"; "ifcColumn"; "ifcFloor"; "ifcFoundation"; "ifcWall"; }

# group: Removing elements with null category
getCategory = archilab.Revit.Elements.Elements.GetCategory(element=select_model_elements)
isNull = Object.IsNull(object=getCategory)
filterByBoolMask = List.FilterByBoolMask(list=select_model_elements, mask=isNull)
filterByBoolMask_2 = List.FilterByBoolMask(list=getCategory, mask=isNull)

# group: Get Single Structural Framing from Selected Elements
string_from_object = FromObject(object=filterByBoolMask_2.out)
categories = Categories("OST_StructuralFraming")
string_from_object_2 = FromObject(object=categories)
eq = string_from_object == string_from_object_2
filterByBoolMask_3 = List.FilterByBoolMask(list=filterByBoolMask.out, mask=eq)
code_block_2 = CodeBlock { 0; 1; }
slice = List.Slice(list=filterByBoolMask_3.in, start=code_block_2.out0, end=code_block_2.out1)

# group: Get Structural Framing Parameters
parameters = Element.Parameters(element=slice)
code_block_3 = CodeBlock { 1; }
flatten = List.Flatten(list=parameters, amount=code_block_3)
groupType = Parameter.GroupType(parameter=parameters@L2)
flatten_2 = List.Flatten(list=groupType, amount=code_block_3)
isNull_2 = Object.IsNull(object=flatten_2)
filterByBoolMask_4 = List.FilterByBoolMask(list=flatten, mask=isNull_2)
filterByBoolMask_5 = List.FilterByBoolMask(list=flatten_2, mask=isNull_2)
string_from_object_3 = FromObject(object=filterByBoolMask_5.out)

# group: Columns for Structural Framing
count = List.Count(list=filterByBoolMask_4.out)
cycle = List.Cycle(list=code_block.out0, amount=count)
sortByKey = List.SortByKey(list=filterByBoolMask_4.out, keys=string_from_object_3)
flatten_3 = List.Flatten(list=sortByKey.sortedKeys)
flatten_4 = List.Flatten(list=sortByKey.sortedList)

# group: Get Single Structural Column from Selected Elements
string_from_object_4 = FromObject(object=filterByBoolMask_2.out)
categories_2 = Categories("OST_StructuralColumns")
string_from_object_5 = FromObject(object=categories_2)
eq_2 = string_from_object_4 == string_from_object_5
filterByBoolMask_6 = List.FilterByBoolMask(list=filterByBoolMask.out, mask=eq_2)
code_block_4 = CodeBlock { 0; 1; }
slice_2 = List.Slice(list=filterByBoolMask_6.in, start=code_block_4.out0, end=code_block_4.out1)

# group: Get Structural Column Parameters
parameters_2 = Element.Parameters(element=slice_2)
code_block_5 = CodeBlock { 1; }
flatten_5 = List.Flatten(list=parameters_2, amount=code_block_5)
groupType_2 = Parameter.GroupType(parameter=parameters_2@L2)
flatten_6 = List.Flatten(list=groupType_2, amount=code_block_5)
isNull_3 = Object.IsNull(object=flatten_6)
filterByBoolMask_7 = List.FilterByBoolMask(list=flatten_5, mask=isNull_3)
filterByBoolMask_8 = List.FilterByBoolMask(list=flatten_6, mask=isNull_3)
string_from_object_6 = FromObject(object=filterByBoolMask_8.out)

# group: Columns for Structural Column
count_2 = List.Count(list=filterByBoolMask_7.out)
cycle_2 = List.Cycle(list=code_block.out1, amount=count_2)
sortByKey_2 = List.SortByKey(list=filterByBoolMask_7.out, keys=string_from_object_6)
flatten_7 = List.Flatten(list=sortByKey_2.sortedKeys)
flatten_8 = List.Flatten(list=sortByKey_2.sortedList)

# group: Get Single Structural Floor from Selected Elements
string_from_object_7 = FromObject(object=filterByBoolMask_2.out)
categories_3 = Categories("OST_Floors")
string_from_object_8 = FromObject(object=categories_3)
eq_3 = string_from_object_7 == string_from_object_8
filterByBoolMask_9 = List.FilterByBoolMask(list=filterByBoolMask.out, mask=eq_3)
code_block_6 = CodeBlock { 0; 1; }
slice_3 = List.Slice(list=filterByBoolMask_9.in, start=code_block_6.out0, end=code_block_6.out1)

# group: Get Structural Floor Parameters
parameters_3 = Element.Parameters(element=slice_3)
code_block_7 = CodeBlock { 1; }
flatten_9 = List.Flatten(list=parameters_3, amount=code_block_7)
groupType_3 = Parameter.GroupType(parameter=parameters_3@L2)
flatten_10 = List.Flatten(list=groupType_3, amount=code_block_7)
isNull_4 = Object.IsNull(object=flatten_10)
filterByBoolMask_10 = List.FilterByBoolMask(list=flatten_9, mask=isNull_4)
filterByBoolMask_11 = List.FilterByBoolMask(list=flatten_10, mask=isNull_4)
string_from_object_9 = FromObject(object=filterByBoolMask_11.out)

# group: Columns for Structural Floor
count_3 = List.Count(list=filterByBoolMask_10.out)
cycle_3 = List.Cycle(list=code_block.out2, amount=count_3)
sortByKey_3 = List.SortByKey(list=filterByBoolMask_10.out, keys=string_from_object_9)
flatten_11 = List.Flatten(list=sortByKey_3.sortedKeys)
flatten_12 = List.Flatten(list=sortByKey_3.sortedList)

# group: Get Single Structural Foundation from Selected Elements
string_from_object_10 = FromObject(object=filterByBoolMask_2.out)
categories_4 = Categories("OST_StructuralFoundation")
string_from_object_11 = FromObject(object=categories_4)
eq_4 = string_from_object_10 == string_from_object_11
filterByBoolMask_12 = List.FilterByBoolMask(list=filterByBoolMask.out, mask=eq_4)
code_block_8 = CodeBlock { 0; 1; }
slice_4 = List.Slice(list=filterByBoolMask_12.in, start=code_block_8.out0, end=code_block_8.out1)

# group: Get Structural Foundation Parameters
parameters_4 = Element.Parameters(element=slice_4)
code_block_9 = CodeBlock { 1; }
flatten_13 = List.Flatten(list=parameters_4, amount=code_block_9)
groupType_4 = Parameter.GroupType(parameter=parameters_4@L2)
flatten_14 = List.Flatten(list=groupType_4, amount=code_block_9)
isNull_5 = Object.IsNull(object=flatten_14)
filterByBoolMask_13 = List.FilterByBoolMask(list=flatten_13, mask=isNull_5)
filterByBoolMask_14 = List.FilterByBoolMask(list=flatten_14, mask=isNull_5)
string_from_object_12 = FromObject(object=filterByBoolMask_14.out)

# group: Columns for Structural Foundation
count_4 = List.Count(list=filterByBoolMask_13.out)
cycle_4 = List.Cycle(list=code_block.out3, amount=count_4)
sortByKey_4 = List.SortByKey(list=filterByBoolMask_13.out, keys=string_from_object_12)
flatten_15 = List.Flatten(list=sortByKey_4.sortedKeys)
flatten_16 = List.Flatten(list=sortByKey_4.sortedList)

# group: Get Single Structural Foundation from Selected Elements
string_from_object_13 = FromObject(object=filterByBoolMask_2.out)
categories_5 = Categories("OST_Walls")
string_from_object_14 = FromObject(object=categories_5)
eq_5 = string_from_object_13 == string_from_object_14
filterByBoolMask_15 = List.FilterByBoolMask(list=filterByBoolMask.out, mask=eq_5)
code_block_10 = CodeBlock { 0; 1; }
slice_5 = List.Slice(list=filterByBoolMask_15.in, start=code_block_10.out0, end=code_block_10.out1)

# group: Get Structural Foundation Parameters
parameters_5 = Element.Parameters(element=slice_5)
code_block_11 = CodeBlock { 1; }
flatten_17 = List.Flatten(list=parameters_5, amount=code_block_11)
groupType_5 = Parameter.GroupType(parameter=parameters_5@L2)
flatten_18 = List.Flatten(list=groupType_5, amount=code_block_11)
isNull_6 = Object.IsNull(object=flatten_18)
filterByBoolMask_16 = List.FilterByBoolMask(list=flatten_17, mask=isNull_6)
filterByBoolMask_17 = List.FilterByBoolMask(list=flatten_18, mask=isNull_6)
string_from_object_15 = FromObject(object=filterByBoolMask_17.out)

# group: Columns for Structural Foundation
count_5 = List.Count(list=filterByBoolMask_16.out)
cycle_5 = List.Cycle(list=code_block.out4, amount=count_5)
sortByKey_5 = List.SortByKey(list=filterByBoolMask_16.out, keys=string_from_object_15)
flatten_19 = List.Flatten(list=sortByKey_5.sortedKeys)
flatten_20 = List.Flatten(list=sortByKey_5.sortedList)

# group: Output csv file
list_create = List.Create(item0=cycle, item1=flatten_3, item2=flatten_4, item3=cycle_2, item4=flatten_7, item5=flatten_8, item6=cycle_3, item7=flatten_11, item8=flatten_12, item9=cycle_4, item10=flatten_15, item11=flatten_16, item12=cycle_5, item13=flatten_19, item14=flatten_20)
transpose = List.Transpose(lists=list_create)
exportCSV = Data.ExportCSV(filePath=file_path, data=transpose)
