# Dynamo graph Pile cap and Piles_with spline.dyn (Dynamo 2.16.1.2727)
# packages: bimorphNodes 5.1.3, archi-lab.net 2023.213.1722

select_model_element = DSModelElementSelection()  # 1 picked in the model; graph input
boundingBox = Element.BoundingBox(element=select_model_element)
categories = Categories("OST_StructuralFoundation")
all_elements_of_category = ElementsOfCategory(Category=categories)
code_block = CodeBlock(a=all_elements_of_category) { a.Name; "Diameter"; }
contains = String.Contains(string=code_block.out0, searchFor=code_block.out1, lacing=Longest)
filterByBoolMask = List.FilterByBoolMask(list=all_elements_of_category, mask=contains, lacing=Longest)
pile_caps = List.Flatten(list=filterByBoolMask.out)
code_block_2 = CodeBlock { 0; }
pile_cap_intersecting_with = Revit.BoundingBox.GetElementsIntersect(boundingBox=boundingBox, elements=pile_caps, tolerance=code_block_2)  # "Pile Cap Intersecting with Spline"
geometry = Element.Geometry(element=select_model_element)

# group: Sorting List of Pile cap on basis on spline
geometry_2 = Element.Geometry(element=pile_cap_intersecting_with, lacing=Longest)
lastItem = List.LastItem(list=geometry_2@L2)
intersect = Geometry.Intersect(geometry=geometry, other=lastItem, lacing=Longest)
startPoint = Curve.StartPoint(curve=intersect)
parameterAtPoint = Curve.ParameterAtPoint(curve=geometry, point=startPoint, lacing=Longest)
flatten = List.Flatten(list=parameterAtPoint)
sortByKey = List.SortByKey(list=pile_cap_intersecting_with, keys=flatten)

boundingBox_2 = Element.BoundingBox(element=sortByKey.sortedList)
piles = List.Flatten(list=filterByBoolMask.in)
pile_that_are_within_pile_cap = Revit.BoundingBox.GetElementsIntersect(boundingBox=boundingBox_2, elements=piles, tolerance=code_block_2)  # "Pile that are within Pile Cap intersecting with spline"

# group: Sorting Piles
location = archilab.Revit.Elements.Elements.Location(element=pile_that_are_within_pile_cap@L2, lacing=Longest)
X = Point.X(point=location.Point)
code_block_3 = CodeBlock { 5; }
round = Math.Round(number=X, digits=code_block_3)
sortByKey_2 = List.SortByKey(list=pile_that_are_within_pile_cap@L2, keys=round@L2)
reverse = List.Reverse(list=sortByKey_2.sortedList@L2)
identity = Object.Identity(object=reverse)
location_2 = archilab.Revit.Elements.Elements.Location(element=identity)
Y = Point.Y(point=location_2.Point)
round_2 = Math.Round(number=Y, digits=code_block_3)
sortByKey_3 = List.SortByKey(list=identity@L2, keys=round_2@L2)
reverse_2 = List.Reverse(list=sortByKey_3.sortedList@L2)

flatten_2 = List.Flatten(list=reverse_2)

# group: Finding Piles associated with pileCap
boundingBox_3 = Element.BoundingBox(element=reverse_2)
toCuboid = BoundingBox.ToCuboid(boundingBox=boundingBox_3)
intersectsSolid = Revit.Element.IntersectsSolid(solids=toCuboid, elements=sortByKey.sortedList)
intersectingElements = Results.SolidIntersectionResult.IntersectingElements(solidIntersectionResult=intersectsSolid)
flatten_3 = List.Flatten(list=intersectingElements)
groupByKey = List.GroupByKey(list=flatten_2, keys=flatten_3)
flatten_4 = List.Flatten(list=intersectsSolid)
uniqueItems = List.UniqueItems(list=flatten_3)
addItemToFront = List.AddItemToFront(item=uniqueItems@L1, list=groupByKey.groups@L2)

flatten_5 = List.Flatten(list=groupByKey.groups)
code_block_4 = CodeBlock { "Mark"; }

# group: Setting Mark values for Piles
starting_number_for_piles = DoubleSlider(1, range=0..500 step 1)  # graph input
suffix_for_pile = StringInput("P")  # graph input
code_block_5 = CodeBlock(n=starting_number_for_piles, c=suffix_for_pile, x=flatten_5) { n; c; c+(n..(n+(List.Count(x)-1))..1); }
code_block_6 = CodeBlock { "."; }
split = String.Split(string=code_block_5.out2, separator0=code_block_6)
code_block_7 = CodeBlock { 0; }
getItemAtIndex = List.GetItemAtIndex(list=split@L2, index=code_block_7)
setParameterByName = Element.SetParameterByName(element=flatten_5, parameterName=code_block_4, value=getItemAtIndex)

flatten_6 = List.Flatten(list=pile_that_are_within_pile_cap)
Y_2 = Point.Y(point=location.Point)
