# Dynamo graph Pile cap and Piles.dyn (Dynamo 2.16.1.2727)
# packages: bimorphNodes 5.1.3, archi-lab.net 2023.213.1722

categories = Categories("OST_StructuralFoundation")
all_elements_of_category = ElementsOfCategory(Category=categories)
code_block = CodeBlock(a=all_elements_of_category) { a.Name; "Diameter"; }
contains = String.Contains(string=code_block.out0, searchFor=code_block.out1, lacing=Longest)
filterByBoolMask = List.FilterByBoolMask(list=all_elements_of_category, mask=contains, lacing=Longest)
pile_caps = List.Flatten(list=filterByBoolMask.out)
boundingBox = Element.BoundingBox(element=pile_caps)
piles = List.Flatten(list=filterByBoolMask.in)
code_block_2 = CodeBlock { 0; }
getElementsIntersect = Revit.BoundingBox.GetElementsIntersect(boundingBox=boundingBox, elements=piles, tolerance=code_block_2)

# group: Sorting Piles
location = archilab.Revit.Elements.Elements.Location(element=piles@L1)
X = Point.X(point=location.Point)
code_block_3 = CodeBlock { 2; }
round = Math.Round(number=X, digits=code_block_3)
sortByKey = List.SortByKey(list=piles, keys=round)
reverse = List.Reverse(list=sortByKey.sortedList)
identity = Object.Identity(object=reverse)
location_2 = archilab.Revit.Elements.Elements.Location(element=identity)
Y = Point.Y(point=location_2.Point)
round_2 = Math.Round(number=Y, digits=code_block_3)
sortByKey_2 = List.SortByKey(list=identity, keys=round_2)
reverse_2 = List.Reverse(list=sortByKey_2.sortedList)

# group: Finding Piles associated with pileCap
boundingBox_2 = Element.BoundingBox(element=reverse_2)
toCuboid = BoundingBox.ToCuboid(boundingBox=boundingBox_2)
intersectsSolid = Revit.Element.IntersectsSolid(solids=toCuboid, elements=pile_caps)
flatten = List.Flatten(list=intersectsSolid)
intersectingElements = Results.SolidIntersectionResult.IntersectingElements(solidIntersectionResult=flatten)
flatten_2 = List.Flatten(list=intersectingElements)
uniqueItems = List.UniqueItems(list=flatten_2)
groupByKey = List.GroupByKey(list=reverse_2, keys=flatten_2)
addItemToFront = List.AddItemToFront(item=uniqueItems@L1, list=groupByKey.groups@L2)

watch = Watch(sortByKey_2.sortedList)
flatten_3 = List.Flatten(list=groupByKey.groups)
code_block_4 = CodeBlock { "Mark"; }

# group: Setting Mark values for Columns
starting_number_for_piles = DoubleSlider(1, range=0..500 step 1)  # graph input
suffix_for_column = StringInput("P")  # graph input
code_block_5 = CodeBlock(n=starting_number_for_piles, c=suffix_for_column, x=flatten_3) { n; c; c+(n..(n+(List.Count(x)-1))..1); }
code_block_6 = CodeBlock { "."; }
split = String.Split(string=code_block_5.out2, separator0=code_block_6)
code_block_7 = CodeBlock { 0; }
getItemAtIndex = List.GetItemAtIndex(list=split@L2, index=code_block_7)
setParameterByName = Element.SetParameterByName(element=flatten_3, parameterName=code_block_4, value=getItemAtIndex)
