# Dynamo graph Place Bore Hole at coordinates.dyn (Dynamo 2.16.1.2727)
# packages: Clockwork for Dynamo 2.x 2.6.0

# group: Additional, if required
categories = Categories("OST_ProjectBasePoint")  # frozen
all_elements_of_category = ElementsOfCategory(Category=categories)  # frozen
code_block = CodeBlock { ["E/W","N/S","Angle to True North"]; }  # frozen
getParameterValueByName = Element.GetParameterValueByName(element=all_elements_of_category, parameterName=code_block, lacing=Longest)  # frozen
code_block_2 = CodeBlock(c=getParameterValueByName) { c[0]; c[1]; c[2]; }  # frozen
code_block_3 = CodeBlock(rot=code_block_2.out2) { rot; }  # frozen
code_block_4 = CodeBlock { 0; 0; }  # frozen
sub = code_block_2.out0 - code_block_4.out0  # frozen
sub_2 = code_block_2.out1 - code_block_4.out1  # frozen
byOrigin = CoordinateSystem.ByOrigin(x=sub, y=sub_2, lacing=Longest)  # frozen

# group: Input Values
file_path = Filename("..\delete me\PLACE AT COORDINATES.csv")  # graph input
levels = Levels("PILING LAYOUT")  # graph input
family_types = FamilyTypes("Pile 2D Symbol Family:600")  # graph input

boolean = BoolSelector(true)
importCSV = Data.ImportCSV(filePath=file_path, transpose=boolean)
code_block_5 = CodeBlock { 0; 1; }

# group: X-Axis
getItemAtIndex = List.GetItemAtIndex(list=importCSV@L2, index=code_block_5.out0)

# group: Y-Axis
getItemAtIndex_2 = List.GetItemAtIndex(list=importCSV@L2, index=code_block_5.out1)

elevation = Level.Elevation(level=levels)
count = List.Count(list=getItemAtIndex)
ofRepeatedItem = List.OfRepeatedItem(item=elevation, amount=count)
byCoordinates = Point.ByCoordinates(x=getItemAtIndex, y=getItemAtIndex_2, z=ofRepeatedItem)
current = Document.Current()
activeView = Document.ActiveView(document=current)
byPointInView = Custom[FamilyInstance.ByPointInView](point=byCoordinates, familyType=family_types, view=activeView)  # package Clockwork for Dynamo 2.x; Places a family instance at a given point in a given view (e.g. a detail component).
