# Grasshopper definition PRE ENGINEERED BUILDING.gh (Grasshopper 1.0.7)
# plug-ins: Karamba3D, ggGHKarambaGHA, ggRhinoIFC

gggrasshoppersettings = GgGrasshopperSettings(
    SettingsData_IFCSettings_Format="STEP",
    SettingsData_IFCSettings_GenerateOwnerHistory=True,
    SettingsData_IFCSettings_IdentifyObsolete=True,
    SettingsData_IFCSettings_LastUsedUnits="Meters",
    SettingsData_IFCSettings_Radians=True,
    SettingsData_IFCSettings_RepMapExport="NONE",
    SettingsData_IFCSettings_Target="Universal",
    SettingsData_IFCSettings_VersionIFC="IFC2x3",
    SettingsData_RevitSettings_Format="STEP",
    SettingsData_RevitSettings_GenerateOwnerHistory=True,
    SettingsData_RevitSettings_IdentifyObsolete=True,
    SettingsData_RevitSettings_LastUsedUnits="Meters",
    SettingsData_RevitSettings_Radians=True,
    SettingsData_RevitSettings_RepMapExport="NONE",
    SettingsData_RevitSettings_Target="Universal",
    SettingsData_RevitSettings_VersionIFC="IFC4")
side_patterns = Slider(0, range=0..5)
width_2 = Slider(15.99, range=0..50)
height = Slider(17.26, range=0..50)
apex_height = Slider(4.73, range=0..10)
pattern = Slider(2, range=0..4)
width1 = Slider(15.82, range=0..50)
start_of_truss = Slider(3.23, range=0..25)
distance_from_top = Slider(3.19, range=1..25)
bay_spacing = Slider(8.07, range=1..25)
no_of_bays = Slider(6, range=1..50)
division_1 = Slider(5, range=1..20)
division_2 = Slider(5, range=1..20)

# ----
# Column Parameters
right_column_start = Slider(-2, range=-6..-1)
left_column_pattern = Slider(1, range=0..2)
right_column_pattern = Slider(1, range=0..2)
column_divisions = Slider(5, range=0..20)
left_column_start = Slider(1, range=0..5)

_0_0_0 = Point(Point(0, 0, 0))
deconstruct = Deconstruct(Point=_0_0_0)  # -> XComponent, YComponent, ZComponent
addition = Addition(A=deconstruct.XComponent, B=width1)
addition_2 = Addition(A=deconstruct.ZComponent, B=height)
addition_3 = Addition(A=addition, B=width_2)
addition_4 = Addition(A=addition_2, B=apex_height)
construct_point = ConstructPoint(XCoordinate=deconstruct.XComponent, YCoordinate=deconstruct.YComponent, ZCoordinate=addition_2)
construct_point_2 = ConstructPoint(XCoordinate=addition_3, YCoordinate=0, ZCoordinate=addition_2)
construct_point_3 = ConstructPoint(XCoordinate=addition_3, YCoordinate=0, ZCoordinate=0)
construct_point_4 = ConstructPoint(XCoordinate=addition, YCoordinate=0, ZCoordinate=addition_4)
subtraction = Subtraction(A=height, B=start_of_truss)
construct_point_5 = ConstructPoint(XCoordinate=deconstruct.XComponent, YCoordinate=deconstruct.YComponent, ZCoordinate=subtraction)
construct_point_6 = ConstructPoint(XCoordinate=addition_3, YCoordinate=deconstruct.YComponent, ZCoordinate=subtraction)
subtraction_2 = Subtraction(A=addition_4, B=distance_from_top)
construct_point_7 = ConstructPoint(XCoordinate=addition, YCoordinate=0, ZCoordinate=subtraction_2)
line = Line(StartPoint=construct_point_5, EndPoint=construct_point_7)
line_2 = Line(StartPoint=construct_point_7, EndPoint=construct_point_6)
line_3 = Line(StartPoint=construct_point_4, EndPoint=construct_point_2)
line_4 = Line(StartPoint=construct_point, EndPoint=construct_point_4)
divide_curve = DivideCurve(Curve=line_4, Count=division_1, Kinks=False)  # -> Points, Tangents, Parameters
divide_curve_2 = DivideCurve(Curve=line_3, Count=division_2, Kinks=False)  # -> Points, Tangents, Parameters
divide_curve_3 = DivideCurve(Curve=line, Count=division_1, Kinks=False)  # -> Points, Tangents, Parameters
divide_curve_4 = DivideCurve(Curve=line_2, Count=division_2, Kinks=False)  # -> Points, Tangents, Parameters

# ----
# column as truss
list_item = ListItem(List=divide_curve_3.Points, Index=left_column_start, Wrap=True)
list_item_2 = ListItem(List=divide_curve_4.Points, Index=right_column_start, Wrap=True)
line_5 = Line(StartPoint=_0_0_0, EndPoint=construct_point_3)
line_sdl = LineSDL(Start=list_item_2, Direction="0,0,-1", Length="100000")
line_sdl_2 = LineSDL(Start=list_item, Direction="0,0,-1", Length="100000")
curve_curve = CurveCurve(CurveA=line_5, CurveB=line_sdl)  # -> Points, ParamsA, ParamsB
curve_curve_2 = CurveCurve(CurveA=line_5, CurveB=line_sdl_2)  # -> Points, ParamsA, ParamsB
bottom_points = Point([curve_curve_2.Points, curve_curve.Points])
top_points = Point([list_item, list_item_2])
line_6 = Line(StartPoint=top_points, EndPoint=bottom_points)

create_set = CreateSet(List=[divide_curve_3.Points, divide_curve_4.Points])  # -> simplify(graft(Set)), Map
create_set_2 = CreateSet(List=[divide_curve.Points, divide_curve_2.Points])  # -> simplify(graft(Set)), Map
point = Point(graft([create_set_2.Set, create_set.Set]))

# ----
# vertical chords
# Chords
# Diagonals forward
# Diagonals backward
panel = Panel("{0;1}")
relative_item = RelativeItem(Tree=point, Offset=panel, WrapPaths=False, WrapItems=False)  # -> ItemA, ItemB
relative_item_2 = RelativeItem(Tree=point, Offset="{1;0}", WrapPaths=False, WrapItems=False)  # -> ItemA, ItemB
relative_item_3 = RelativeItem(Tree=point, Offset="{1;1}", WrapPaths=False, WrapItems=False)  # -> ItemA, ItemB
relative_item_4 = RelativeItem(Tree=point, Offset="{1;-1}", WrapPaths=False, WrapItems=False)  # -> ItemA, ItemB
line_7 = Line(StartPoint=relative_item.ItemA, EndPoint=relative_item.ItemB)
line_8 = Line(StartPoint=relative_item_2.ItemA, EndPoint=relative_item_2.ItemB)
line_9 = Line(StartPoint=relative_item_3.ItemA, EndPoint=relative_item_3.ItemB)
line_10 = Line(StartPoint=relative_item_4.ItemA, EndPoint=relative_item_4.ItemB)
vetical_posts = Line(line_7)
chords = Line(line_8)
diagonal = Line(line_9)
diagonal_2 = Line(line_10)

curve_closest_point = CurveClosestPoint(Point=construct_point_5, Curve=line_6)  # -> Point, Parameter, Distance

# ----
# Diagonal Pattern 1
diagonal_3 = Line(flatten(diagonal))
diagonal_4 = Line(flatten(diagonal_2))
dispatch = Dispatch(List=diagonal_4, DispatchPattern=[True, False])  # -> ListA, ListB
dispatch_2 = Dispatch(List=diagonal_3, DispatchPattern=[True, False])  # -> ListA, ListB
line_11 = Line(dispatch_2.ListA)  # "/././."
line_12 = Line(dispatch_2.ListB)  # "././././"
line_13 = Line(dispatch.ListA)  # "\.\.\.\."
line_14 = Line(dispatch.ListB)  # ".\.\.\.\"
merge = Merge(Data1=line_11, Data2=line_14)
merge_2 = Merge(Data1=line_12, Data2=line_13)
line_15 = Line(merge_2)  # "/\/\/\"
line_16 = Line(merge)  # "\/\/\/"

# ----
# Diagonal Pattern 2
diagonal_5 = Line(flatten(diagonal_2))
diagonal_6 = Line(flatten(diagonal))
split_list = SplitList(List=diagonal_6, Index=division_1)  # -> ListA, ListB
split_list_2 = SplitList(List=diagonal_5, Index=division_1)  # -> ListA, ListB
merge_3 = Merge(Data1=split_list.ListA, Data2=split_list_2.ListB)
merge_4 = Merge(Data1=split_list.ListB, Data2=split_list_2.ListA)
line_17 = Line(merge_3)  # "\\\///"
line_18 = Line(merge_4)  # "///\\\"

line_19 = Line(StartPoint=top_points, EndPoint=curve_closest_point.Point)  # -> graft(Line)
line_20 = Line(StartPoint=curve_closest_point.Point, EndPoint=bottom_points)  # -> flatten(Line)
dispatch_3 = Dispatch(List=line_20, DispatchPattern=[True, False])  # -> ListA, ListB
divide_curve_5 = DivideCurve(Curve=dispatch_3.ListA, Count=column_divisions, Kinks=False)  # -> reverse(simplify(graft(Points))), Tangents, Parameters
divide_curve_6 = DivideCurve(Curve=dispatch_3.ListB, Count=column_divisions, Kinks=False)  # -> reverse(simplify(graft(Points))), Tangents, Parameters
pattern_2 = Integer(pattern)
stream_filter = StreamFilter(Gate=pattern_2, Stream1=line_16, Stream2=line_15, Stream3=line_17, Stream4=line_18)
point_2 = Point(reverse(simplify(graft([construct_point_3, _0_0_0]))))
point_3 = Point(simplify(graft([construct_point_5, construct_point_6])))
line_21 = Line(StartPoint=point_2, EndPoint=point_3)  # -> flatten(Line)
dispatch_4 = Dispatch(List=line_21, DispatchPattern=[True, False])  # -> ListA, ListB
divide_curve_7 = DivideCurve(Curve=dispatch_4.ListA, Count=column_divisions, Kinks=False)  # -> simplify(graft(Points)), Tangents, Parameters
divide_curve_8 = DivideCurve(Curve=dispatch_4.ListB, Count=column_divisions, Kinks=False)  # -> simplify(graft(Points)), Tangents, Parameters

# ----
# Generating Cross Bracings
series = Series(Start=0, Step=bay_spacing, Count=no_of_bays)
series_2 = Series(Start=0, Step=bay_spacing, Count=no_of_bays)
unit_y = UnitY(Factor=series)
unit_y_2 = UnitY(Factor=series_2)
move = Move(Geometry=divide_curve_7.Points, Motion=unit_y)  # -> flatten(Geometry), Transform
move_2 = Move(Geometry=divide_curve_8.Points, Motion=unit_y_2)  # -> flatten(Geometry), Transform
partition_list = PartitionList(List=move.Geometry, Size=no_of_bays)
partition_list_2 = PartitionList(List=move_2.Geometry, Size=no_of_bays)
flip_matrix = FlipMatrix(Data=partition_list)
flip_matrix_2 = FlipMatrix(Data=partition_list_2)
panel_2 = Panel("""0
-1""")
panel_3 = Panel("""0
-1""")
list_item_3 = ListItem(List=flip_matrix, Index=panel_2, Wrap=True)  # -> simplify(flatten(Item))
list_item_4 = ListItem(List=flip_matrix_2, Index=panel_3, Wrap=True)  # -> simplify(flatten(Item))
dispatch_5 = Dispatch(List=list_item_3, DispatchPattern=[True, False])  # -> ListA, ListB
dispatch_6 = Dispatch(List=list_item_4, DispatchPattern=[True, False])  # -> ListA, ListB
shift_list = ShiftList(List=dispatch_5.ListB, Shift=1, Wrap=True)
shift_list_2 = ShiftList(List=dispatch_5.ListA, Shift=1, Wrap=True)
shift_list_3 = ShiftList(List=dispatch_6.ListB, Shift=1, Wrap=True)
shift_list_4 = ShiftList(List=dispatch_6.ListA, Shift=1, Wrap=True)
line_22 = Line(StartPoint=dispatch_5.ListA, EndPoint=shift_list)
line_23 = Line(StartPoint=dispatch_5.ListB, EndPoint=shift_list_2)
line_24 = Line(StartPoint=dispatch_6.ListA, EndPoint=shift_list_3)
line_25 = Line(StartPoint=dispatch_6.ListB, EndPoint=shift_list_4)
cull_index = CullIndex(List=line_22, Indices="-1", Wrap=True)
cull_index_2 = CullIndex(List=line_23, Indices="-1", Wrap=True)
cull_index_3 = CullIndex(List=line_24, Indices="-1", Wrap=True)
cull_index_4 = CullIndex(List=line_25, Indices="-1", Wrap=True)
line_26 = Line([cull_index_2, cull_index])
line_27 = Line([cull_index_4, cull_index_3])
line_28 = Line([line_26, line_27])

point_4 = Point(graft([divide_curve_5.Points, divide_curve_7.Points]))
point_5 = Point(simplify(graft([divide_curve_6.Points, divide_curve_8.Points])))
supports_one_row = Point(graft([construct_point_3, _0_0_0]))

# ----
# Diagonal Pattern of column
panel_4 = Panel("{1;1}")
relative_item_5 = RelativeItem(Tree=point_4, Offset=panel_4, WrapPaths=False, WrapItems=False)  # -> ItemA, ItemB
relative_item_6 = RelativeItem(Tree=point_4, Offset="{0;1}", WrapPaths=False, WrapItems=False)  # -> ItemA, ItemB
relative_item_7 = RelativeItem(Tree=point_4, Offset="{1;0}", WrapPaths=False, WrapItems=False)  # -> ItemA, ItemB
relative_item_8 = RelativeItem(Tree=point_4, Offset="{1;-1}", WrapPaths=False, WrapItems=False)  # -> ItemA, ItemB
relative_item_9 = RelativeItem(Tree=point_5, Offset="{1;1}", WrapPaths=False, WrapItems=False)  # -> ItemA, ItemB
relative_item_10 = RelativeItem(Tree=point_5, Offset="{0;1}", WrapPaths=False, WrapItems=False)  # -> ItemA, ItemB
relative_item_11 = RelativeItem(Tree=point_5, Offset="{1;0}", WrapPaths=False, WrapItems=False)  # -> ItemA, ItemB
relative_item_12 = RelativeItem(Tree=point_5, Offset="{1;-1}", WrapPaths=False, WrapItems=False)  # -> ItemA, ItemB
line_29 = Line(StartPoint=relative_item_5.ItemA, EndPoint=relative_item_5.ItemB)
line_30 = Line(StartPoint=relative_item_6.ItemA, EndPoint=relative_item_6.ItemB)
line_31 = Line(StartPoint=relative_item_7.ItemA, EndPoint=relative_item_7.ItemB)
line_32 = Line(StartPoint=relative_item_8.ItemA, EndPoint=relative_item_8.ItemB)
line_33 = Line(StartPoint=relative_item_9.ItemA, EndPoint=relative_item_9.ItemB)
line_34 = Line(StartPoint=relative_item_10.ItemA, EndPoint=relative_item_10.ItemB)
line_35 = Line(StartPoint=relative_item_11.ItemA, EndPoint=relative_item_11.ItemB)
line_36 = Line(StartPoint=relative_item_12.ItemA, EndPoint=relative_item_12.ItemB)
line_37 = Line(line_29)
line_38 = Line(line_32)
line_39 = Line(line_33)
line_40 = Line(line_36)
line_41 = Line(flatten(line_37))
line_42 = Line(flatten(line_38))
line_43 = Line(flatten(line_39))
line_44 = Line(flatten(line_40))
dispatch_7 = Dispatch(List=line_41, DispatchPattern=[True, False])  # -> ListA, ListB
dispatch_8 = Dispatch(List=line_42, DispatchPattern=[True, False])  # -> ListA, ListB
dispatch_9 = Dispatch(List=line_43, DispatchPattern=[True, False])  # -> ListA, ListB
dispatch_10 = Dispatch(List=line_44, DispatchPattern=[True, False])  # -> ListA, ListB
line_45 = Line(dispatch_7.ListA)  # "D.\.\"
line_46 = Line(dispatch_7.ListB)  # "D\.\."
line_47 = Line(dispatch_8.ListA)  # "D././"
line_48 = Line(dispatch_9.ListA)  # "D.\.\"
line_49 = Line(dispatch_8.ListB)  # "D/./."
line_50 = Line(dispatch_9.ListB)  # "D\.\."
line_51 = Line(dispatch_10.ListA)  # "D././"
line_52 = Line(dispatch_10.ListB)  # "D/./."
merge_5 = Merge(Data1=line_46, Data2=line_47)
merge_6 = Merge(Data1=line_45, Data2=line_49)
merge_7 = Merge(Data1=line_50, Data2=line_51)
merge_8 = Merge(Data1=line_48, Data2=line_52)
left_column_pattern_2 = Integer(left_column_pattern)
right_column_pattern_2 = Integer(right_column_pattern)
stream_filter_2 = StreamFilter(Gate=left_column_pattern_2, Stream1=merge_6, Stream2=merge_5)
stream_filter_3 = StreamFilter(Gate=right_column_pattern_2, Stream1=merge_8, Stream2=merge_7)
column_diagonal_right = Line(graft(stream_filter_3))
column_diagonal_left = Line(graft(stream_filter_2))
v1 = Line(graft(line_31))
h1 = Line(graft(line_30))
h2 = Line(line_34)
v2 = Line(line_35)

diagonals = Line(graft(stream_filter))
vetical_posts_2 = Line(vetical_posts)
chords_2 = Line(chords)

# ----
# Nodes for Load Application
series_3 = Series(Start=0, Step=bay_spacing, Count=no_of_bays)
series_4 = Series(Start=0, Step=bay_spacing, Count=no_of_bays)
series_5 = Series(Start=0, Step=bay_spacing, Count=no_of_bays)
series_6 = Series(Start=0, Step=bay_spacing, Count=no_of_bays)
unit_y_3 = UnitY(Factor=series_3)
unit_y_4 = UnitY(Factor=series_4)
unit_y_5 = UnitY(Factor=series_5)
unit_y_6 = UnitY(Factor=series_6)
move_3 = Move(Geometry=graft(divide_curve_7.Points), Motion=unit_y_3)  # -> Geometry, Transform
move_4 = Move(Geometry=graft(divide_curve_8.Points), Motion=unit_y_4)  # -> Geometry, Transform
move_5 = Move(Geometry=graft(divide_curve_6.Points), Motion=unit_y_5)  # -> Geometry, Transform
move_6 = Move(Geometry=graft(divide_curve_6.Points), Motion=unit_y_6)  # -> Geometry, Transform
point_6 = Point(move_3.Geometry)
point_7 = Point(move_4.Geometry)
point_8 = Point(move_5.Geometry)
point_9 = Point(move_6.Geometry)

line_53 = Line(StartPoint=point_2, EndPoint=point_3)  # -> graft(Line)
series_7 = Series(Start=0, Step=bay_spacing, Count=no_of_bays)

# ----
# Extracting First and last bracing
integer = Integer(no_of_bays)
integer_2 = Integer(no_of_bays)
subtraction_3 = Subtraction(A=integer, B="1")
subtraction_4 = Subtraction(A=integer_2, B="1")
multiplication = Multiplication(A=subtraction_3, B="2")
subtraction_5 = Subtraction(A=integer, B="2")
multiplication_2 = Multiplication(A=subtraction_4, B="2")
subtraction_6 = Subtraction(A=integer_2, B="2")
list_item_5 = ListItem(List=line_26, Index=[subtraction_3, "0"], Wrap=True)
list_item_6 = ListItem(List=line_27, Index=[subtraction_4, "0"], Wrap=True)
subtraction_7 = Subtraction(A=multiplication, B="1")
subtraction_8 = Subtraction(A=multiplication_2, B="1")
list_item_7 = ListItem(List=line_26, Index=[subtraction_5, subtraction_7], Wrap=True)
list_item_8 = ListItem(List=line_27, Index=[subtraction_6, subtraction_8], Wrap=True)
line_54 = Line([list_item_5, list_item_7])
line_55 = Line([list_item_6, list_item_8])
line_56 = Line([line_55, line_54])

# ----
# Side Bracing Pattern1
series_8 = Series(Start=0, Step=bay_spacing, Count=no_of_bays)
unit_y_7 = UnitY(Factor=series_8)
move_7 = Move(Geometry=graft([divide_curve_7.Points, divide_curve_8.Points]), Motion=unit_y_7)  # -> Geometry, Transform
shift_list_5 = ShiftList(List=move_7.Geometry, Shift=1, Wrap=True)
line_57 = Line(StartPoint=move_7.Geometry, EndPoint=shift_list_5)  # -> flatten(Line)
cull_nth = CullNth(List=line_57, CullFrequency=no_of_bays)
subtraction_9 = Subtraction(A=no_of_bays, B="1")
multiplication_3 = Multiplication(A=subtraction_9, B="2")
partition_list_3 = PartitionList(List=cull_nth, Size=multiplication_3)
flip_matrix_3 = FlipMatrix(Data=partition_list_3)
dispatch_11 = Dispatch(List=flip_matrix_3, DispatchPattern=[True, False])  # -> ListA, ListB
line_58 = Line(dispatch_11.ListA)
line_59 = Line(dispatch_11.ListB)
stream_filter_4 = StreamFilter(Gate=side_patterns, Stream1=cull_nth, Stream2=line_58, Stream3=line_59, Stream4=line_28, Stream5=line_56)

unit_y_8 = UnitY(Factor=series_7)

# ----
# Supports
point_10 = Point(flatten(divide_curve_7.Points))
point_11 = Point(flatten(divide_curve_6.Points))
point_12 = Point(flatten(divide_curve_5.Points))
point_13 = Point(flatten(divide_curve_8.Points))
list_item_9 = ListItem(List=point_10, Index="0", Wrap=True)
list_item_10 = ListItem(List=point_11, Index="0", Wrap=True)
list_item_11 = ListItem(List=point_12, Index="0", Wrap=True)
list_item_12 = ListItem(List=point_13, Index="0", Wrap=True)
supports = Point(graft([list_item_9, list_item_11, list_item_10, list_item_12]))

move_8 = Move(Geometry=point, Motion=unit_y_8)  # -> Geometry, Transform
all_points_except_supports = Point(move_8.Geometry)
nodes_other_than_support = Point(graft([point_5, point_4, point]))

# ----
# Copying in Y-Direction
series_9 = Series(Start=0, Step=bay_spacing, Count=no_of_bays)
series_10 = Series(Start=0, Step=bay_spacing, Count=no_of_bays)
series_11 = Series(Start=0, Step=bay_spacing, Count=no_of_bays)
series_12 = Series(Start=0, Step=bay_spacing, Count=no_of_bays)
series_13 = Series(Start=0, Step=bay_spacing, Count=no_of_bays)
series_14 = Series(Start=0, Step=bay_spacing, Count=no_of_bays)
series_15 = Series(Start=0, Step=bay_spacing, Count=no_of_bays)
series_16 = Series(Start=0, Step=bay_spacing, Count=no_of_bays)
series_17 = Series(Start=0, Step=bay_spacing, Count=no_of_bays)
series_18 = Series(Start=0, Step=bay_spacing, Count=no_of_bays)
series_19 = Series(Start=0, Step=bay_spacing, Count=no_of_bays)
series_20 = Series(Start=0, Step=bay_spacing, Count=no_of_bays)
unit_y_9 = UnitY(Factor=series_9)
unit_y_10 = UnitY(Factor=series_10)
unit_y_11 = UnitY(Factor=series_18)
unit_y_12 = UnitY(Factor=series_14)
unit_y_13 = UnitY(Factor=series_15)
unit_y_14 = UnitY(Factor=series_11)
unit_y_15 = UnitY(Factor=series_12)
unit_y_16 = UnitY(Factor=series_13)
unit_y_17 = UnitY(Factor=series_16)
unit_y_18 = UnitY(Factor=series_17)
unit_y_19 = UnitY(Factor=series_19)
unit_y_20 = UnitY(Factor=series_20)
move_9 = Move(Geometry=chords_2, Motion=unit_y_9)  # -> Geometry, Transform
move_10 = Move(Geometry=diagonals, Motion=unit_y_10)  # -> Geometry, Transform
move_11 = Move(Geometry=nodes_other_than_support, Motion=unit_y_11)  # -> Geometry, Transform
move_12 = Move(Geometry=vetical_posts_2, Motion=unit_y_13)  # -> Geometry, Transform
move_13 = Move(Geometry=supports, Motion=unit_y_12)  # -> flatten(Geometry), Transform
move_14 = Move(Geometry=column_diagonal_left, Motion=unit_y_14)  # -> Geometry, Transform
move_15 = Move(Geometry=v1, Motion=unit_y_15)  # -> Geometry, Transform
move_16 = Move(Geometry=h1, Motion=unit_y_16)  # -> Geometry, Transform
move_17 = Move(Geometry=column_diagonal_right, Motion=unit_y_20)  # -> Geometry, Transform
move_18 = Move(Geometry=h2, Motion=unit_y_19)  # -> Geometry, Transform
move_19 = Move(Geometry=line_19, Motion=unit_y_17)  # -> Geometry, Transform
move_20 = Move(Geometry=v2, Motion=unit_y_18)  # -> Geometry, Transform

point_14 = Point(relative_item.ItemA)
shift_list_6 = ShiftList(List=all_points_except_supports, Shift=1, Wrap=True)
series_21 = Series(Start=0, Step=bay_spacing, Count=no_of_bays)
unit_y_21 = UnitY(Factor=series_21)
line_60 = Line(StartPoint=all_points_except_supports, EndPoint=shift_list_6)
move_21 = Move(Geometry=point_14, Motion=unit_y_21)  # -> Geometry, Transform
cull_nth_2 = CullNth(List=line_60, CullFrequency=no_of_bays)
column_post_small = Line(move_19.Geometry)
line_61 = Line(move_15.Geometry)
line_62 = Line(move_14.Geometry)
line_63 = Line(move_16.Geometry)
line_64 = Line(move_18.Geometry)
line_65 = Line(move_17.Geometry)
column_vertical_posts = Line(move_20.Geometry)
set_difference = SetDifference(SetA=move_11.Geometry, SetB=move_13.Geometry)

# ----
# Members
column_vertical_members = Line([column_post_small, line_61, column_vertical_posts])
column_horizontal_members = Line([line_63, line_64])
truss_chords = Line(move_9.Geometry)
truss_vertical_posts = Line(move_12.Geometry)
truss_diagonals = Line(move_10.Geometry)
column_diagonals = Line([line_62, line_65])
side_bracings = Line(stream_filter_4)
purlins = Line(cull_nth_2)

top_surface_nodes_or_loading = Point(move_21.Geometry)

# ----
# Nodes
nodes_other_tahn_supports = Point(set_difference)
supports_2 = Point(move_13.Geometry)

panel_5 = Panel("""Purlins
T_Post
T_Chord
T_Diagonal
C_Vertical
C_Horizontal
C_Diagonal
C_Bracing""")

# ----
# Cross Sections
cross_section_range_selector_karamba3d = CrossSectionRangeSelectorKaramba3D(MaximumHeight_cm=-1, MaximumWidth_cm=-1, menu=[dropdown(2), dropdown(3), dropdown(1)])
panel_6 = Panel("""Purlins
T_Post
T_Chord
T_Diagonal
C_Vertical
C_Horizontal
C_Diagonal
C_Bracing""")
panel_7 = Panel("""27
27
27
27
27
27
27
27""")
cross_section_selector_karamba3d = CrossSectionSelectorKaramba3D(
    CrossSections=cross_section_range_selector_karamba3d,
    NameOrListIndexOfCrossSection=graft(panel_7),
    ElementsIdentifiers=graft(panel_6))  # -> CrossSection, Info
cross_section_karamba3d = CrossSectionKaramba3D(simplify(cross_section_selector_karamba3d.CrossSection))

panel_8 = Panel(cross_section_range_selector_karamba3d)
line_to_beam_karamba3d = LineToBeamKaramba3D(
    Line=side_bracings,
    New=True,
    Remove=True,
    LimitDistance_m=0.005,
    Bending=True,
    SetBucklingLength=True,
    ToPolylineMaxAngle=0.03,
    ToPolylineTolerance=0.01,
    ToPolylineMinEdgeLength=0.25)  # -> Element, Points, Info

# ----
# Elements
entwine = Entwine(
    Branch00=purlins,
    Branch01=truss_vertical_posts,
    Branch02=truss_chords,
    Branch03=truss_diagonals,
    Branch04=column_vertical_members,
    Branch05=column_horizontal_members,
    Branch06=column_diagonals,
    Branch07=side_bracings,
    FlattenInputs=True)
line_to_beam_karamba3d_2 = LineToBeamKaramba3D(
    Line=entwine,
    Identifier=graft(panel_5),
    New=True,
    Remove=True,
    LimitDistance_m=0.005,
    Bending=True,
    SetBucklingLength=True,
    ToPolylineMaxAngle=0.03,
    ToPolylineTolerance=0.01,
    ToPolylineMinEdgeLength=0.25)  # -> Element, Points, Info
element_karamba3d = ElementKaramba3D(line_to_beam_karamba3d_2.Element)

# ----
# Loads
number_slider = Slider(5, range=1..500)
unit_x = UnitX(Factor=number_slider)
unit_z = UnitZ(Factor=expr("-x", Slider(33, range=1..500)))
loads_karamba3d = LoadsKaramba3D(ForceVector=unit_z, Local=False, PosInd=top_surface_nodes_or_loading, LCase="0", mode="Point")
loads_karamba3d_2 = LoadsKaramba3D(ForceVector=unit_x, Local=False, PosInd=point_6, LCase="0", mode="Point")
load_karamba3d = LoadKaramba3D(loads_karamba3d)
load_karamba3d_2 = LoadKaramba3D(loads_karamba3d_2)

# ----
# Supports
support_karamba3d = SupportKaramba3D(PosInd=supports_2, menu=[buttons(on, on, on, off, off, off)])
support_karamba3d_2 = SupportKaramba3D(support_karamba3d)

material_selection_karamba3d = MaterialSelectionKaramba3D(menu=[dropdown(1), dropdown(3)])
beam_joints_karamba3d = BeamJointsKaramba3D(
    CtKNMAtStartingNode=Vector(0, 0, 0),
    CrKNmRadAtStartingNode=Vector(0, 0, 0),
    CtKNMAtEndNode=Vector(0, 0, 0),
    CrKNmRadAtEndNode=Vector(0, 0, 0),
    menu=[buttons(on, on, on, off, off, on), buttons(on, on, on, off, off, off)])
cross_section_karamba3d_2 = CrossSectionKaramba3D(flatten(cross_section_karamba3d))
element_karamba3d_2 = ElementKaramba3D(flatten(element_karamba3d))
support_karamba3d_3 = SupportKaramba3D(flatten(support_karamba3d_2))
load_karamba3d_3 = LoadKaramba3D(flatten([load_karamba3d, load_karamba3d_2]))
assemble_model_karamba3d = AssembleModelKaramba3D(
    Elem=element_karamba3d_2,
    Support=support_karamba3d_3,
    Load=load_karamba3d_3,
    CrossSection=cross_section_karamba3d_2,
    Material=material_selection_karamba3d,
    Joint=beam_joints_karamba3d,
    LimitDistance_m=0.005)  # -> Model, Info, Mass_kg, CenterOfGravity, LoadCaseNames
model_view_karamba3d = ModelViewKaramba3D(ResultFactors=1, ResultCase=-1)  # -> Model, DeformedMesh, DeformedAxes, DeformedModel
beam_view_karamba3d = BeamViewKaramba3D(Model=model_view_karamba3d.Model)  # -> Model, MeshesOfRenderedBeams, DeformedBeamAxes, LegendColors, LegendTags
panel_9 = Panel("C:\Users\hp\Desktop\RESEARCH\Rhino Grasshopper\parametric modelling\my files\PEB\fullModelIFC.ifc")
panel_10 = Panel("C:\Users\hp\Desktop\RESEARCH\Rhino Grasshopper\parametric modelling\my files\PEB\fullMode3.stp")
ggkarambaexport = GgKarambaExport(
    Enabled=Toggle(True),
    Model=beam_view_karamba3d.Model,
    IFC4=True,
    FilePath=panel_9,
    Zip=False,
    Compliant=True,
    VerticalColumns=True)
export_model_to_dstv_karamba3d = ExportModelToDStVKaramba3D(
    Path=panel_10,
    ExportPath="C:\Users\hp\Desktop\RESEARCH\Rhino Grasshopper\parametric modelling\my files\PEB\fullMode3.stp",
    menu=[buttons(off, off, off, on, off)])  # -> DStV, Info
ggifc_baketofile = GgIFCBaketoFile(ggkarambaexport)
panel_11 = Panel(ggkarambaexport)
